# Grasshopper definition WIP_170822_CityScope_Andorra.gh (Grasshopper 0.9.76)
# plug-ins: Python Interpreter, Firefly.X, Human, HDTTreeUtils

panel = Panel("red: UI reference")
# grid size
# resolution
# types of lego (0-7)
# grid mask
# excel sheet
# slider setup
panel_2 = Panel("magenta: module ID")
# yellow: external file links
panel_3 = Panel(" green: initial inputs")
panel_4 = Panel(" blue: rhino references")
site = BooleanToggle(True)
# CONTROL PANEL
vb = VBScript()  # -> out; disabled
# ---------- vb: VB ----------
    If (_form IsNot Nothing) Then Return

    _form = New Form()
    _form.StartPosition = FormStartPosition.Manual
    _form.ShowInTaskbar = False
    _form.FormBorderStyle = FormBorderStyle.SizableToolWindow
    _form.Text = "Component List"
    AddHandler _form.FormClosing, AddressOf FormClosing

    _list = New ListView()
    _list.View = View.Details
    _list.AllowColumnReorder = False
    _list.MultiSelect = False
    _list.Columns.Add("Component", 200)
    _list.Columns.Add("Runtime", 80)
    _list.Dock = DockStyle.Fill
    AddHandler _list.ItemActivate, AddressOf ItemActivate
    _form.Controls.Add(_list)

    Grasshopper.GUI.GH_WindowsFormUtil.CenterFormOnCursor(_form, True)
    _form.Show(Instances.DocumentEditor)
    Instances.DocumentEditor.FormShepard.RegisterForm(_form)

    If (_handler) Then Return
    AddHandler GrasshopperDocument.SolutionEnd, AddressOf DocumentSolutionEnd
# ---------- vb: VB additional code ----------
  Private _form As Form
  Private _list As ListView
  Private _handler As Boolean = False

  Private Sub FormClosing(sender As Object, e As EventArgs)
    If (_form Is Nothing) Then Return
    RemoveHandler _form.FormClosing, AddressOf FormClosing
    RemoveHandler _list.ItemActivate, AddressOf ItemActivate

    _form = Nothing
    _list = Nothing
  End Sub
  Private Sub ItemActivate(sender As Object, e As EventArgs)
    Try
      Dim item As ListViewItem = _list.SelectedItems(0)
      Dim target As RectangleF = TryCast(item.Tag, IGH_DocumentObject).Attributes.Bounds
      Dim view As New Grasshopper.GUI.Canvas.GH_NamedView(Instances.ActiveCanvas.Viewport.ScreenPort, target)
      view.SetToViewport(Instances.ActiveCanvas, 350)
    Catch
    End Try
  End Sub

  Private Sub DocumentSolutionEnd(sender As Object, e As GH_SolutionEventArgs)
    If (_form Is Nothing) Then Return
    _list.Items.Clear()

    Dim doc As GH_Document = e.Document
    If (doc Is Nothing) Then Return
    If (doc.ObjectCount = 0) Then Return

    Dim times As Int64()
    Dim objects As IGH_DocumentObject()
    ReDim times(doc.ObjectCount - 1)
    ReDim objects(doc.ObjectCount - 1)
    For i As Int32 = 0 To doc.ObjectCount - 1
      Dim obj As IGH_ActiveObject = TryCast(doc.Objects(i), IGH_ActiveObject)
      If (obj Is Nothing) Then
        times(i) = 0
        objects(i) = doc.Objects(i)
        Continue For
      End If

      times(i) = obj.ProcessorTime.Ticks
      objects(i) = obj
    Next
    Array.Sort(times, objects)

    For i As Int32 = doc.ObjectCount - 1 To 0 Step -1
      If (times(i) < TimeSpan.TicksPerMillisecond) Then Continue For
      Dim item As New ListViewItem(objects(i).Name)
      item.Tag = objects(i)
      item.SubItems.Add(String.Format("{0:0} ms", New TimeSpan(times(i)).TotalMilliseconds))
      _list.Items.Add(item)
    Next
    _list.Invalidate()
  End Sub
# ---------- end vb ----------
offset_of_interactive_grid = Panel("""49
13""")
webcam_screenshot_filepath = FilePath("C:\Users\admin\Documents\Andorra\Andorra\Grasshopper\Data\Screenshots\170808_andorra.jpg")
# use screenshot as a static workfile / faster computation
webcam_screenshot_filepath_2 = FilePath("C:\Users\CPG_Andorra\Documents\GitHub\Andorra\Grasshopper\Data\Screenshots\170808_andorra.jpg")
satellite_image_file_path = FilePath("C:\Users\CPG_Andorra\Documents\GitHub\Andorra\Grasshopper\Data\Satellite\cityscopeortorotated.jpg")
shrink_factor = Slider(0.52, range=0..1)
full_site_bldg_heights = FilePath("C:\Users\CPG_Andorra\Documents\GitHub\Andorra\data\Grids\andorra_buildingheights.txt")
radar_chart_weights = FilePath("C:\Users\CPG_Andorra\Documents\GitHub\Andorra\Grasshopper\Data\Chart\1708014_Weights_2.csv")
bar_chart_indicators = FilePath("C:\Users\CPG_Andorra\Documents\GitHub\Andorra\Grasshopper\Data\Bar graph\170814_Radar_indicators_and _Weights_V11-Indicators_1.csv")
satellite_image_file_path_2 = FilePath("C:\Users\admin\Documents\Andorra\Andorra\Grasshopper\Data\Satellite\andorrasatellite2.jpg")
int = Slider(13, range=1..44)
int_2 = Slider(49, range=0..100)
full_site_bldg_heights_2 = FilePath("C:\Users\admin\Documents\Andorra\Andorra\data\Grids\andorra_buildingheights.txt")
int_3 = Slider(22, range=1..100)
int_4 = Slider(22, range=0..100)
_1_1_1_camera = Panel("Meshes")
radar_chart_weights_2 = FilePath("C:\Users\admin\Documents\Andorra\Andorra\Grasshopper\Data\Chart\1708014_Weights_2.csv")
bar_chart_indicators_2 = FilePath("C:\Users\admin\Documents\Andorra\Andorra\Grasshopper\Data\Bar graph\170814_Radar_indicators_and _Weights_V11-Indicators_1.csv")
full_site_grid = FilePath("C:\Users\CPG_Andorra\Documents\GitHub\Andorra\data\Grids\andorra_landuses.txt")
reset_counter = Button()
amenities = FilePath("C:\Users\CPG_Andorra\Documents\GitHub\Andorra\Grasshopper\Data\Amenities\170807_csv_amenities_test.csv")
masks = FilePath("C:\Users\CPG_Andorra\Documents\GitHub\Andorra\data\Grids\andorra_masks.txt")
full_site_grid_2 = FilePath("C:\Users\admin\Documents\Andorra\Andorra\data\Grids\andorra_landuses.txt")
amenities_2 = FilePath("C:\Users\admin\Documents\Andorra\Andorra\Grasshopper\Data\Amenities\170807_csv_amenities_test.csv")
masks_2 = FilePath("C:\Users\admin\Documents\Andorra\Andorra\data\Grids\andorra_masks.txt")
filter = StreamFilter(Gate=site, Stream0=webcam_screenshot_filepath, Stream1=webcam_screenshot_filepath_2)
panel_5 = Panel("2")
filter_2 = StreamFilter(Gate=site, Stream0=full_site_grid_2, Stream1=full_site_grid)
filter_3 = StreamFilter(Gate=site, Stream0=full_site_bldg_heights_2, Stream1=full_site_bldg_heights)
filter_4 = StreamFilter(Gate=site, Stream0=satellite_image_file_path_2, Stream1=satellite_image_file_path)
filter_5 = StreamFilter(Gate=site, Stream0=masks_2, Stream1=masks)
filter_6 = StreamFilter(Gate=site, Stream0=amenities_2, Stream1=amenities)
filter_7 = StreamFilter(Gate=site, Stream0=radar_chart_weights_2, Stream1=radar_chart_weights)
filter_8 = StreamFilter(Gate=site, Stream0=bar_chart_indicators_2, Stream1=bar_chart_indicators)
video_stream = WebCamVideoStream()
load_bitmap = LoadBitmap(FilePathToImageLocation=filter)
panel_6 = Panel(filter)
interactive_area_x_offset = Integer(int_2)
interactive_area_y_offset = Integer(int)
cell_size_shrink_factor = Number(shrink_factor)
grid_resolution = Integer("4")
grid_x_extent = Integer(int_4)
grid_y_extent = Integer(int_3)
grid_corner_points = Point([<point referenced from the Rhino model> x4])
dock_position_ref_pts = Point([<point referenced from the Rhino model> x4])
cell_size_reference_point = Point(<point referenced from the Rhino model>)
interactive_grid_start_point = Point(<point referenced from the Rhino model>)
slider_1_reference_points = Point(graft([<point referenced from the Rhino model> x2]))
slider_2_reference_points = Point(graft([<point referenced from the Rhino model> x2]))
reference_mesh_without_labels = Mesh([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])
module_type_reference_mesh_0_to_5 = Mesh([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])
module_type_reference_mesh_1_or_7 = Mesh(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)
amenity_ground_floor_reference_mesh = Mesh([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])
panel_7 = Panel(filter_2)
panel_8 = Panel(filter_3)
panel_9 = Panel(filter_4)
panel_10 = Panel(filter_5)
panel_11 = Panel(filter_6)
panel_12 = Panel(filter_7)
panel_13 = Panel(filter_8)
dist = Distance(PointA=interactive_grid_start_point, PointB=cell_size_reference_point)
webcam_stream = Data(video_stream)
# 1.1.1 Notes: Used for CV calibration
webcam_stream_2 = Data(webcam_stream)
info = BitmapInfo(FireflyBitmap=webcam_stream)  # -> PixelResolutionInXAxis, PixelResolutionInYAxis
mesh = MeshFromImage(Bmp=webcam_stream_2, Sx=Domain(0, 1), Sy=Domain(0, 1), Z=0, C=True)
python = PythonScript(webcam_data=info.PixelResolutionInXAxis, reset=reset_counter)  # -> out, counter
# ---------- python: Python ----------
import rhinoscriptsyntax as rs
import scriptcontext as sc

if "counter" not in sc.sticky or reset:
    sc.sticky["counter"] = -1

if webcam_data is not None and sc.sticky["counter"] < 10:
    sc.sticky["counter"] += 1

counter = sc.sticky["counter"]
# ---------- end python ----------
move = Move(Geometry=mesh, Motion=Vector(0, 0, -0.1))  # -> Geometry, Transform
mesh_2 = Mesh(move.Geometry)
counter = Integer(python.counter)
global_counter = Panel(counter)
division = Division(A=dist, B=grid_x_extent)
quad_cell_size = Number(division)
panel_14 = Panel(quad_cell_size)
quad_cell_area = Number(expr("x^2", quad_cell_size))
merge = Merge(Data1=graft(module_type_reference_mesh_0_to_5), Data2=graft(reference_mesh_without_labels))
cell_size_shrink_factor_2 = Number(cell_size_shrink_factor)
move_2 = Move(G=module_type_reference_mesh_1_or_7, num=cell_size_shrink_factor_2)
module_type_reference_mesh_origin_1_or_7 = Mesh(move_2)
counter_2 = Integer(counter)
full_site_bldg_heights_3 = FilePath(filter_3)
counter_3 = Integer(counter)
counter_4 = Integer(counter)
full_site_grid_3 = FilePath(filter_2)
equals = Equality(FirstNumber=counter_2, SecondNumber=0)  # -> Equality, Inequality
masks_3 = FilePath(filter_5)
equals_2 = Equality(FirstNumber=counter_4, SecondNumber=0)  # -> Equality, Inequality
equals_3 = Equality(FirstNumber=counter_3, SecondNumber=0)  # -> Equality, Inequality
# 1.3 BUILDING TYPES AND HEIGHTS
_1_3_building_types_and_meshes = Panel("Meshes")
file_read_on_load = StreamFilter(Gate=equals.Equality, Stream1=masks_3)
offcolor = ColourSwatch(SwatchColor=RGB(255, 122, 122))
sidewalk = ColourSwatch(SwatchColor=RGB(107, 107, 107))
text = ColourSwatch(SwatchColor=RGB(0, 0, 0))
res_warm = ColourSwatch(SwatchColor=RGB(255, 251, 230))
text_new = ColourSwatch(SwatchColor=RGB(64, 64, 64))
# 1.3 / Note: Below is how meshes are colored in Rhino.
mesh_3 = Mesh([<mesh referenced from the Rhino model> x3])
res_color = ColourSwatch(SwatchColor=RGB(251, 255, 122))
res_gray = ColourSwatch(SwatchColor=RGB(227, 227, 227))
off_gray = ColourSwatch(SwatchColor=RGB(171, 171, 171))
blank = ColourSwatch(SwatchColor=RGB(110, 110, 110))
parking = ColourSwatch(SwatchColor=RGB(196, 156, 100))
park = ColourSwatch(SwatchColor=RGB(165, 201, 44))
road = ColourSwatch(SwatchColor=RGB(64, 64, 64))
bikelane = ColourSwatch(SwatchColor=RGB(86, 135, 87))
off_cold = ColourSwatch(SwatchColor=RGB(230, 242, 255))
file_read_on_load_2 = StreamFilter(Gate=equals_2.Equality, Stream1=full_site_grid_3)
file_read_on_load_3 = StreamFilter(Gate=equals_3.Equality, Stream1=full_site_bldg_heights_3)
grid_corner_points_2 = Point(grid_corner_points)
# 1.2 PHYSICAL UI
_1_2_physical_ui = Panel("Meshes")
webcam_stream_3 = Data(webcam_stream)
# 1.1.2 CV ANALYSIS
_1_1_2_cv_analysis = Panel("Meshes")
grid_resolution_2 = Integer(grid_resolution)
file = ReadFile(File=file_read_on_load, PerLineParse=True)
grid_x_extent_2 = Integer(grid_x_extent)
grid_y_extent_2 = Integer(grid_y_extent)
rec = DataRecorder(file, DataLimit=66, RecordData=True)
slider_1_reference_points_2 = Point(slider_1_reference_points)
slider_2_reference_points_2 = Point(slider_2_reference_points)
mcol = MeshColours(Mesh=mesh_3, Colours=offcolor)

# ---- group: Sample White
pt = Point(<point referenced from the Rhino model>)

# ---- group: Sample Black
pt_2 = Point(<point referenced from the Rhino model>)

# ---- group: Sample Red
pt_3 = Point(<point referenced from the Rhino model>)

# ----
file_2 = ReadFile(File=file_read_on_load_2, PerLineParse=True)
webcam_stream_4 = Data(webcam_stream)
file_3 = ReadFile(File=file_read_on_load_3, PerLineParse=True)
rec_2 = DataRecorder(file_3, DataLimit=66, RecordData=True)
pdecon = Deconstruct(Point=pt)  # -> XComponent, YComponent, ZComponent
pdecon_2 = Deconstruct(Point=pt_2)  # -> XComponent, YComponent, ZComponent
pdecon_3 = Deconstruct(Point=pt_3)  # -> XComponent, YComponent, ZComponent
mesh_4 = Mesh(mcol)
color = ColourSwatch(SwatchColor=RGB(255, 0, 230))
pline = PolyLine(Vertices=grid_corner_points_2, Closed=False)
multiplication = Multiplication(A=grid_x_extent_2, B=2)
multiplication_2 = Multiplication(A=grid_y_extent_2, B=2)
series = Series(Start=0, Step=1, Count=grid_x_extent_2)
series_2 = Series(Start=0, Step=1, Count=grid_y_extent_2)
division_2 = Division(A=grid_resolution_2, B=2)
pt_4 = Point(slider_1_reference_points_2)
frgb = ColourRGBF(Alpha=1, Red=pdecon.XComponent, Green=pdecon.YComponent, Blue=pdecon.ZComponent)
frgb_2 = ColourRGBF(Alpha=1, Red=pdecon_2.XComponent, Green=pdecon_2.YComponent, Blue=pdecon_2.ZComponent)
frgb_3 = ColourRGBF(Alpha=1, Red=pdecon_3.XComponent, Green=pdecon_3.YComponent, Blue=pdecon_3.ZComponent)
# 1.2 Notes: For slider calibration
#  -color 1: slider base color sample
#  -color 2: non-slider color sample
sample_color_1 = Point(<point referenced from the Rhino model>)
sample_color_2 = Point(<point referenced from the Rhino model>)
flip = FlipMatrix(Data=pt_4)
preview = CustomPreview(Geometry=pline, Shader=color)
sanity_check = Panel(rec_2)
panel_15 = Panel(masks_3)
sanity_check_2 = Panel(rec)
panel_16 = Panel(full_site_grid_3)
multiplication_3 = Multiplication(A=series, B=division_2)
multiplication_4 = Multiplication(A=series_2, B=grid_resolution_2)
sanity_check_3 = Panel(file_2)
panel_17 = Panel(full_site_bldg_heights_3)
perspective = Perspective(pt=grid_corner_points_2, int_2=multiplication, int=multiplication_2)
merge_2 = Merge(Data1=frgb, Data2=frgb_2, Data3=frgb_3)
item = ListItem(List=flip, Index=0, Wrap=True)  # -> Item, Item1
sample = BitmapSampler(
    BitmapToModify=webcam_stream_4,
    PointToSample=sample_color_1,
    BitmapToModify_2=webcam_stream_4,
    PointToSample_2=sample_color_1,
    bitmap_filter=0)  # -> SampledImageData, SampledImageData_2
sample_2 = BitmapSampler(
    BitmapToModify=webcam_stream_4,
    PointToSample=sample_color_2,
    BitmapToModify_2=webcam_stream_4,
    PointToSample_2=sample_color_2,
    bitmap_filter=0)  # -> SampledImageData, SampledImageData_2
office_floors = Slider(3, range=0..5)
set = Slider(2, range=0..5)
retail_floors = Slider(1, range=0..5)
height_sets_txt = FilePath("C:\Users\admin\Documents\Andorra\Andorra\Grasshopper\Data\height_sets.txt")
height_sets_txt_2 = FilePath("C:\Users\CPG_Andorra\Documents\GitHub\Andorra\Grasshopper\Data\height_sets.txt")
multiplication_5 = Multiplication(A=multiplication_4, B=grid_y_extent_2)
reference_colors = Colour(merge_2)
ln = Line(StartPoint=item.Item, EndPoint=item.Item1)
col = Colour(sample.SampledImageData_2)
col_2 = Colour(sample_2.SampledImageData_2)
load_sets = Button()
save_sets = Button()
addition = Addition(A=multiplication_3, B=graft(multiplication_5))
filter_9 = StreamFilter(Gate=site, Stream0=height_sets_txt, Stream1=height_sets_txt_2)
counter_5 = Integer(counter)
merge_3 = Merge(Data1=col, Data2=col_2)
crv = Curve(reparameterize(ln))
preview_2 = CustomPreview(Geometry=crv, Shader=ColourSwatch(SwatchColor=RGB(255, 0, 230)))
divide = DivideCurve(Curve=crv, Count=Slider(20, range=9..99), Kinks=False)  # -> Points, Tangents, Parameters
keystoned_grid_points = Point(perspective)
pshift = ShiftPaths(Data=addition, Offset=-1)
multiplication_6 = Multiplication(A=grid_x_extent_2, B=2)
slider_color_reference = Colour([RGB(101, 5, 10), RGB(15, 11, 16)])
slider_sample_points = Point(divide.Points)
addition_2 = Addition(A=pshift, B=1)
addition_3 = Addition(A=pshift, B=multiplication_6)
pshift_2 = ShiftPaths(Data=keystoned_grid_points, Offset=-1)
grid_sample_points = Point(pshift_2)
box = CenterBox(Base=grid_sample_points, X=0.003, Y=0.003, Z=0.003)
box_2 = Box(box)
addition_4 = Addition(A=addition_3, B=1)
grid_sample_points_2 = Point(pshift_2)
sample_3 = BitmapSampler(
    BitmapToModify=webcam_stream_4,
    PointToSample=slider_sample_points,
    BitmapToModify_2=webcam_stream_4,
    PointToSample_2=slider_sample_points,
    bitmap_filter=0)  # -> SampledImageData, SampledImageData_2
pshift_3 = ShiftPaths(Data=sample_3.SampledImageData_2, Offset=-1)
grid_data = SubList(List=file_3, Domain=Domain(6, 65), Wrap=True)  # -> List, Index
grid_data_2 = SubList(List=file, Domain=Domain(6, 65), Wrap=True)  # -> List, Index
grid_info = SubList(List=file_2, Domain=Domain(0, 5), Wrap=True)  # -> List, Index
grid_data_3 = SubList(List=file_2, Domain=Domain(6, 65), Wrap=True)  # -> List, Index
sample_4 = BitmapSampler(
    BitmapToModify=webcam_stream_3,
    PointToSample=grid_sample_points_2,
    BitmapToModify_2=webcam_stream_3,
    PointToSample_2=grid_sample_points_2,
    bitmap_filter=0)  # -> SampledImageData, SampledImageData_2
slider_sampled_color = Colour(pshift_3)
item_2 = ListItem(List=grid_info.List, Index=0, Wrap=True)  # -> Item, Item1
grid_sampled_colors = Colour(sample_4.SampledImageData_2)
split = TextSplit(Text=grid_data_2.List, Separators=" ")
panel_18 = Panel(sample_3.SampledImageData_2)
ascii = ASCII(T=item_2.Item)
ascii_2 = ASCII_2(T=item_2.Item1)
split_2 = TextSplit(Text=grid_data_3.List, Separators=" ")
lng = ListLength(List=reference_colors)
rep = ReplaceText(Text=grid_data.List, Find=",5", RecursiveReplace=False)
trim = TextTrim(Text=split, Start=True, End=True)
slider_calc = SliderCalc(C_2=crv, L=slider_sample_points, P=slider_sampled_color, C=slider_color_reference)  # -> D, int_2
series_3 = Series(Start=0, Step=1, Count=lng)
cp = ClosestPoint(Point=grid_sampled_colors, Cloud=reference_colors)  # -> ClosestPoint, CPIndex, Distance
rev = ReverseList(List=flatten(split_2))
rec_3 = DataRecorder(ascii_2, DataLimit=1, RecordData=True)
rec_4 = DataRecorder(ascii, DataLimit=1, RecordData=True)
len = TextLength(Text=trim)
item_3 = ListItem(List=slider_color_reference, Index=slider_calc.int_2, Wrap=True)
reference_color_index = Integer(flatten(series_3))
split_3 = TextSplit(Text=rep, Separators=" ")
rec_5 = DataRecorder(rev, DataLimit=5760, RecordData=True)
equals_4 = Equality(FirstNumber=len, SecondNumber=0)  # -> Equality, Inequality
preview_3 = CustomPreview(Geometry=slider_sample_points, Shader=item_3)
full_site_grid_x_extent = Panel(rec_4)
full_site_grid_x_extent_2 = Integer(full_site_grid_x_extent)
full_site_grid_y_extent = Panel(rec_3)
full_site_grid_y_extent_2 = Integer(full_site_grid_y_extent)
trim_2 = TextTrim(Text=split_3, Start=True, End=True)
slider_read_override = Slider(0.66, range=0..1)
cull = CullPattern(List=trim, CullPattern=equals_4.Inequality)

# ---- group: slider read 0-1
slider_read = Number(slider_calc.D)

# ----
color_space_visualization = Panel(" ")

reference_colors_2 = Colour(reference_colors)  # disabled
sampled_colors = Colour(grid_sampled_colors)  # disabled
argb = SplitARGB(Colour=reference_colors_2)  # -> Alpha, Red, Green, Blue; disabled
ahsv = SplitAHSV(Colour=reference_colors_2)  # -> Alpha, Hue, Saturation, Value; disabled
argb_2 = SplitARGB(Colour=sampled_colors)  # -> Alpha, Red, Green, Blue; disabled
ahsv_2 = SplitAHSV(Colour=sampled_colors)  # -> Alpha, Hue, Saturation, Value; disabled
range = Range(Domain=Domain(0, 1), Steps=10)  # disabled
pt_5 = Point(reference_colors_2)  # disabled
pt_6 = Point(sampled_colors)  # disabled
pt_7 = ConstructPoint(XCoordinate=argb.Red, YCoordinate=argb.Green, ZCoordinate=argb.Blue)  # disabled
pt_8 = ConstructPoint(XCoordinate=ahsv.Hue, YCoordinate=ahsv.Saturation, ZCoordinate=ahsv.Value)  # disabled
pt_9 = ConstructPoint(XCoordinate=argb_2.Red, YCoordinate=argb_2.Green, ZCoordinate=argb_2.Blue)  # disabled
pt_10 = ConstructPoint(XCoordinate=ahsv_2.Hue, YCoordinate=ahsv_2.Saturation, ZCoordinate=ahsv_2.Value)  # disabled
graft = GraftTree(Tree=range, IncludeEmptyLists=True, IncludeNullItems=True)  # disabled
sph = Sphere(Base=pt_7, Radius=0.05)  # disabled
sph_2 = Sphere(Base=pt_8, Radius=0.05)  # disabled
pt_11 = ConstructPoint(XCoordinate=range, YCoordinate=graft, ZCoordinate=0)  # disabled
Z = UnitZ(Factor=range)  # disabled
color_reference = CustomPreview(Geometry=sph, Shader=reference_colors_2)  # disabled
preview_4 = CustomPreview(Geometry=sph_2, Shader=reference_colors_2)  # disabled
sampled_points = CustomPreview(Geometry=pt_9, Shader=sampled_colors)  # disabled
preview_5 = CustomPreview(Geometry=pt_10, Shader=sampled_colors)  # disabled
pshift_4 = ShiftPaths(Data=pt_11, Offset=-1)  # disabled
graft_2 = GraftTree(Tree=Z, IncludeEmptyLists=True, IncludeNullItems=True)  # disabled
box_3 = Box2Pt(PointA=Point(0, 0, 0), PointB=Point(1, 1, 1), Plane=PlaneXY(0, 0, 0))  # disabled
box_4 = Box2Pt(PointA=Point(0, 0, 0), PointB=Point(1, 1, 1), Plane=PlaneXY(0, 0, 0))  # disabled
move_3 = Move(Geometry=pshift_4, Motion=graft_2)  # -> Geometry, Transform; disabled
voronoi³ = Voronoi3D(Points=pt_7, Box=box_3)  # -> Cells, Boundary; disabled
voronoi³_2 = Voronoi3D(Points=pt_8, Box=box_4)  # -> Cells, Boundary; disabled
flip_2 = FlipMatrix(Data=move_3.Geometry)  # disabled
color_space_partitions_rgb = Brep(voronoi³.Cells)  # disabled
colored_space_partitions_hsv = Brep(voronoi³_2.Cells)  # disabled
pt_12 = Point(flip_2)  # disabled
pdecon_4 = Deconstruct(Point=pt_12)  # -> XComponent, YComponent, ZComponent; disabled
hsl = ColourHSL(Alpha=1, Hue=pdecon_4.XComponent, Saturation=pdecon_4.YComponent, Luminance=pdecon_4.ZComponent)  # disabled
frgb_4 = ColourRGBF(Alpha=1, Red=pdecon_4.XComponent, Green=pdecon_4.YComponent, Blue=pdecon_4.ZComponent)  # disabled
preview_6 = CustomPreview(Geometry=pt_12, Shader=frgb_4)  # disabled
preview_7 = CustomPreview(Geometry=pt_12, Shader=hsl)  # disabled
pt_13 = Point(frgb_4)  # disabled

item_4 = ListItem(List=reference_color_index, Index=cp.CPIndex, Wrap=False)
item_5 = ListItem(List=reference_colors, Index=cp.CPIndex, Wrap=False)
grid_sampled_colors_2 = Colour(item_5)
preview_8 = CustomPreview(Geometry=box_2, Shader=grid_sampled_colors_2)
len_2 = TextLength(Text=trim_2)
rev_2 = ReverseList(List=flatten(cull))
pshift_5 = ShiftPaths(Data=slider_read, Offset=-1)
equals_5 = Equality(FirstNumber=len_2, SecondNumber=0)  # -> Equality, Inequality
grid_sampled_color_codes = Integer(item_4)

# ---- group: sample quad cell
item_6 = ListItem(List=grid_sample_points_2, Index=pshift, Wrap=False)
item_7 = ListItem(List=grid_sample_points_2, Index=addition_3, Wrap=False)
item_8 = ListItem(List=grid_sample_points_2, Index=addition_2, Wrap=False)
item_9 = ListItem(List=grid_sample_points_2, Index=addition_4, Wrap=False)

# ----
rev_3 = ReverseList(List=rev_2)
cull_2 = CullPattern(List=trim_2, CullPattern=equals_5.Inequality)
switch_override = StreamFilter(Gate=Toggle(False), Stream0=pshift_5, Stream1=slider_read_override)
rec_6 = DataRecorder(rev_3, DataLimit=5760, RecordData=True)
rev_4 = ReverseList(List=flatten(cull_2))  # -> reverse(List)
mask = Number(rec_6)
rec_7 = DataRecorder(rev_4, DataLimit=5760, RecordData=True)

# ---- group: quad cell color codes
item_10 = ListItem(List=grid_sampled_color_codes, Index=pshift, Wrap=False)
item_11 = ListItem(List=grid_sampled_color_codes, Index=addition_3, Wrap=False)
item_12 = ListItem(List=grid_sampled_color_codes, Index=addition_4, Wrap=False)
item_13 = ListItem(List=grid_sampled_color_codes, Index=addition_2, Wrap=False)

# ----
addition_5 = Addition(A=item_6, B=item_9)
division_3 = Division(A=addition_5, B=2)
_1_to_30 = Domain(Domain(1, 30))
_0_to_9 = Domain(Domain(0, 9))
quad_cell_mid_points = Point(division_3)
quad_cell_mid_points_2 = Point(quad_cell_mid_points)
xy = XYPlane(Origin=quad_cell_mid_points_2)
merge_4 = Merge(Data1=graft(item_10), Data2=graft(item_11), Data3=graft(item_12), Data4=graft(item_13))
quad_cell_color_codes = Integer(merge_4)
quad_cell_color_codes_2 = Integer(quad_cell_color_codes)

# ---- group: quad cell color codes
panel_19 = Panel("2,0,0,0\t2,1,0,0\t2,0,1,0\t2,0,0,1\t2,1,1,0\t2,1,0,1\t2,0,1,1\t2,1,1,1\t3,0,0,0\t3,1,0,0\t3,0,1,0\t3,0,0,1\t3,1,1,0\t3,1,0,1\t3,0,1,1\t3,1,1,1\t4,0,0,0\t4,1,0,0\t4,0,1,0\t4,0,0,1\t4,1,1,0\t4,1,0,1\t4,0,1,1\t4,1,1,1\t5,0,0,0\t5,1,0,0\t5,0,1,0\t5,0,0,1\t5,1,1,0\t5,1,0,1\t5,0,1,1\t5,1,1,1")

# ----
rev_5 = ReverseList(List=quad_cell_color_codes_2)
txt = Text(rev_5)

# ---- group: quad cell color code permutations with rotation
panel_20 = Panel("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")

# ----
join = TextJoin(Text=txt, Join=",")
dock_position_ref_pts_2 = Point(dock_position_ref_pts)
webcam_stream_5 = Data(webcam_stream)
split_4 = TextSplit(Text=panel_20, Separators="\t")
pshift_6 = ShiftPaths(Data=join, Offset=-1)
panel_21 = Panel("270,270,270,270,270,270,270,270,270,270,270,270,270,270,270,270,270,270,270,270,270,270,270,270,270,270,270,270,270,270,270,270,180,180,180,180,180,180,180,180,180,180,180,180,180,180,180,180,180,180,180,180,180,180,180,180,180,180,180,180,180,180,180,180,90,90,90,90,90,90,90,90,90,90,90,90,90,90,90,90,90,90,90,90,90,90,90,90,90,90,90,90,90,90,90,90,0,0,0,0,0,0,0,0,0,0,0,0,0,0,0,0,0,0,0,0,0,0,0,0,0,0,0,0,0,0,0,0")
split_5 = TextSplit(Text=panel_21, Separators=",")
all_possible_quad_cell_color_code = Text(split_4)
sample_5 = BitmapSampler(
    BitmapToModify=webcam_stream_5,
    PointToSample=dock_position_ref_pts_2,
    BitmapToModify_2=webcam_stream_5,
    PointToSample_2=dock_position_ref_pts_2,
    bitmap_filter=0)  # -> SampledImageData, SampledImageData_2
sanity_check_4 = Panel(all_possible_quad_cell_color_code)
reference_color = Colour(reference_colors)
quad_cell_rotation = Text(split_5)
sanity_check_5 = Panel(quad_cell_rotation)
reference_color_index_2 = Integer(reference_color_index)
col_3 = Colour(sample_5.SampledImageData_2)
cp_2 = ClosestPoint(Point=col_3, Cloud=reference_color)  # -> ClosestPoint, CPIndex, Distance
item_14 = ListItem(List=reference_color_index_2, Index=cp_2.CPIndex, Wrap=False)
lng_2 = ListLength(List=all_possible_quad_cell_color_code)
dock_cell_color_code = Integer(item_14)
division_4 = Division(A=lng_2, B="4")
series_4 = Series(Start=0, Step=1, Count=division_4)
rev_6 = ReverseList(List=dock_cell_color_code)
multiplication_7 = Multiplication(A=division_4, B="4")
pshift_7 = ShiftPaths(Data=series_4, Offset=-1)
txt_2 = Text(dock_cell_color_code)
join_2 = TextJoin(Text=txt_2, Join=",")
repeat = RepeatData(Data=pshift_7, Length=multiplication_7)
pshift_8 = ShiftPaths(Data=repeat, Offset=-1)
mirrored_quad_cell_color_codes = Text(pshift_6)
mirrored_dock_cell_color_code = Text(join_2)
quad_cell_color_code_index = Integer(pshift_8)
sanity_check_6 = Panel(mirrored_dock_cell_color_code)
keysearch = KeyValueSearch(Keys=all_possible_quad_cell_color_code, Values=quad_cell_color_code_index, Search=graft(mirrored_quad_cell_color_codes))
keysearch_2 = KeyValueSearch(Keys=all_possible_quad_cell_color_code, Values=quad_cell_color_code_index, Search=graft(mirrored_dock_cell_color_code))
keysearch_3 = KeyValueSearch(Keys=all_possible_quad_cell_color_code, Values=quad_cell_rotation, Search=graft(mirrored_dock_cell_color_code))
nullrep = ReplaceNulls(Items=keysearch, Replacements="-1")  # -> Items, Count
nullrep_2 = ReplaceNulls(Items=keysearch_2, Replacements="-1")  # -> Items, Count
nullrep_3 = ReplaceNulls(Items=keysearch_3, Replacements="0")  # -> Items, Count
pshift_9 = ShiftPaths(Data=nullrep.Items, Offset=-1)
pshift_10 = ShiftPaths(Data=nullrep_2.Items, Offset=-1)
pshift_11 = ShiftPaths(Data=nullrep_3.Items, Offset=-1)
grid_y_extent_3 = Integer(grid_y_extent)
grid_x_extent_3 = Integer(grid_x_extent)
dockid_override = Slider(-1, range=-1..5)
rotation = Slider(180, range=0..360)
pshift_12 = ShiftPaths(Data=pshift_9, Offset=-1)
series_5 = Series(Start=0, Step=1, Count=grid_y_extent_3)
series_6 = Series(Start=0, Step=1, Count=grid_x_extent_3)
multiplication_8 = Multiplication(A=grid_x_extent_3, B=grid_y_extent_3)
graft_3 = GraftTree(Tree=series_5, IncludeEmptyLists=True, IncludeNullItems=True)
quad_cell_module_id = Integer(pshift_12)
module_id = Integer(quad_cell_module_id)
tag = TextTag3D(Location=xy, Text=module_id, Size=Slider(0.007, range=0..0.05), Justification=5)
sanity_check_7 = Panel(quad_cell_module_id)
repeat_2 = RepeatData(Data=series_6, Length=multiplication_8)
repeat_3 = RepeatData(Data=graft_3, Length=grid_x_extent_3)
repeat_4 = RepeatData(Data=rotation, Length=multiplication_8)
dockid_override_2 = Integer(dockid_override)
dock_rotation = Integer(pshift_11)
sanity_check_8 = Panel(dock_rotation)
pshift_13 = ShiftPaths(Data=repeat_2, Offset=-2)
pshift_14 = ShiftPaths(Data=repeat_3, Offset=-3)
pshift_15 = ShiftPaths(Data=repeat_4, Offset=-1)
switch_override_2 = StreamFilter(Gate=Toggle(False), Stream0=pshift_10, Stream1=dockid_override_2)
x = Integer(pshift_13)
rotation_2 = Integer(pshift_15)
y = Integer(pshift_14)
dock_id = Integer(switch_override_2)
dock_id_2 = Integer(dock_id)
dock_id_3 = Integer(dock_id)
rec_8 = DataRecorder(graft([switch_override, dock_id_3]), DataLimit=5, RecordData=True)
panel_22 = Panel(rec_8)
slider_switch = PythonScript(data_stream=rec_8, remap_1=_0_to_9, remap_2=_1_to_30)  # -> out, slider_1, slider_2, slider_changed, dock_switch, dock_on; inputs data_stream: tree
# ---------- slider_switch: Python ----------
import rhinoscriptsyntax as rs
import clr
clr.AddReference("Grasshopper")
from Grasshopper import DataTree as Tree
from Grasshopper.Kernel.Data import GH_Path as Path
from Grasshopper.Kernel import GH_Document as GH_doc
from System import Array
import scriptcontext as sc

def list_to_tree(input, none_and_holes=True, source=[0]):
    """Transforms nestings of lists or tuples to a Grasshopper DataTree"""
    def proc(input,tree,track):
        path = Path(Array[int](track))
        if len(input) == 0 and none_and_holes: tree.EnsurePath(path); return
        for i,item in enumerate(input):
            if hasattr(item, '__iter__'): #if list or tuple
                track.append(i); proc(item,tree,track); track.pop()
            else:
                if none_and_holes: tree.Insert(item,path,i)
                elif item is not None: tree.Add(item,path)
    if input is not None: t=Tree[object]();proc(input,t,source[:]);return t

slider_read = data_stream.Branch(Path(0,0))
dockID_read = data_stream.Branch(Path(0,1))

print slider_read
print dockID_read

slider_read_min = 0
slider_read_max = 1

slider_1_min = remap_1[0]
slider_1_max = remap_1[1]
slider_1_range = remap_1[1] - remap_1[0]

slider_2_min = remap_2[0]
slider_2_max = remap_2[1]
slider_2_range = remap_2[1] - remap_2[0]

slider_1 = int((((slider_read[4] - slider_read_min) * slider_1_range)) + slider_1_min)
slider_2 = int((((slider_read[4] - slider_read_min) * slider_2_range)) + slider_2_min)

print slider_1
print slider_2


print dockID_read[0]

slider_changed = (slider_read[0] != slider_read[4])
dock_on = (dockID_read[0] != -1)
dock_on2 = (dockID_read[2] != -1)
dock_switch = (dock_on != dock_on2)

print slider_changed
print dock_switch
print dock_on
# ---------- end slider_switch ----------
panel_23 = Panel(slider_switch.slider_1)
panel_24 = Panel(slider_switch.slider_2)
panel_25 = Panel(slider_switch.slider_changed)
panel_26 = Panel(slider_switch.dock_switch)
panel_27 = Panel(slider_switch.dock_on)
and = GateAnd(A=panel_25, B=invert(panel_27))
filter_10 = StreamFilter(Gate=panel_26, Stream1=panel_23)
filter_11 = StreamFilter(Gate=and, Stream1=panel_23)
rec_9 = DataRecorder(filter_10, DataLimit=1, RecordData=True)
panel_28 = Panel(rec_9)
rec_10 = DataRecorder(filter_11, DataLimit=1, RecordData=True)
panel_29 = Panel(rec_10)
filter_12 = StreamFilter(Gate=panel_27, Stream0=panel_29, Stream1=panel_28)
filter_13 = StreamFilter(Gate=panel_27, Stream1=panel_24)
null = NullItem(Item=filter_12)  # -> NullFlags, InvalidFlags, Description
filter_14 = StreamFilter(Gate=null.NullFlags, Stream0=filter_12, Stream1=0)
slider_1 = Panel(filter_14)
slider_2 = Panel(filter_13)
slider_1_visualization_switch = Number(slider_1)
slider_2_bldg_heights = Number(slider_2)
slider_2_bldg_heights_2 = Integer(slider_2_bldg_heights)
slider_2_bldg_heights_3 = Number(flatten(slider_2_bldg_heights_2))
building_height_calculations = PythonScript(
    counter=counter_5,
    height_sets_txt=filter_9,
    setID=set,
    dockID=dock_id_2,
    bldg_height=slider_2_bldg_heights_3,
    load_sets=load_sets,
    save_sets=save_sets,
    retail_flr=retail_floors,
    office_flr=office_floors)  # -> out, building_heights, curr_dock_display; inputs counter: Int32, setID: Int32, dockID: Int32, bldg_height: Int32
# ---------- building_height_calculations: Python ----------
import rhinoscriptsyntax as rs

#read saved sets
if load_sets or counter == 0:
    height_sets = []
    height_sets_txts = open(height_sets_txt, "r+")
    for line in height_sets_txts:
        curr_set = [int(x) for x in line.strip().split(",")]
        height_sets.append(curr_set)


#print height_sets
#print setID
#print dockID
#print bldg_height
print bldg_height
#update current set / dock display
if dockID != -1:
    if bldg_height == None:
        bldg_height = 1
    height_sets[setID][dockID] = bldg_height
    if bldg_height < (office_flr + retail_flr):
        curr_dock_display = [retail_flr, bldg_height - retail_flr]
    else:
        curr_dock_display = [retail_flr, office_flr, bldg_height - retail_flr - office_flr]
    curr_dock_display = [int(x) for x in curr_dock_display]

#save sets
if save_sets:
    height_sets_txt_to_save = ""
    for curr_set in height_sets:
        height_sets_txt_to_save = height_sets_txt_to_save + ','.join(str(x) for x in curr_set) + "\n"
    with open(height_sets_txt, "w") as height_sets_txts:
        height_sets_txts.write(height_sets_txt_to_save)

curr_set = height_sets[setID]
floor_numbers = list(curr_set)
building_heights = list(curr_set)

for i in range(0,3):
    if floor_numbers[i] <= 1:
        continue
    if floor_numbers[i] < (office_flr + retail_flr):
        floor_numbers[i] = curr_set[i] - retail_flr
        floor_numbers[i+3] = curr_set[i+3] - retail_flr
    else:
        floor_numbers[i] = curr_set[i] - (retail_flr + office_flr)
        floor_numbers[i+3] = floor_numbers[i+3] + office_flr
for i in range(3,6):
    if floor_numbers[i] <= 1:
        continue
    else:
        floor_numbers[i] -= 1
floor_numbers = [x for x in floor_numbers]

#print building_heights
#print floor_numbers
#print curr_dock_display
# ---------- end building_height_calculations ----------
nullrep_4 = ReplaceNulls(Items=building_height_calculations.building_heights, Replacements=0)  # -> Items, Count
floor_for_each_type = Text(nullrep_4.Items)
panel_30 = Panel(floor_for_each_type)
slider_1_visualization_switch_2 = Integer(slider_1_visualization_switch)
slider_1_visualization_switch_3 = Integer(slider_1_visualization_switch_2)
equals_6 = Equality(FirstNumber=slider_1_visualization_switch_3, SecondNumber="6")  # -> Equality, Inequality
item_15 = ListItem(List=merge, Index=equals_6.Equality, Wrap=True)
pshift_16 = ShiftPaths(Data=item_15, Offset=-1)
move_4 = Move(G=pshift_16, num=cell_size_shrink_factor_2)
module_type_reference_mesh_origin_0_to_5 = Mesh(move_4)
sanity_check_9 = Panel(dock_id)
csv_reader_module = FilePath("C:\Users\CPG_Andorra\AppData\Roaming\Grasshopper\Libraries\LumenWorks.Framework.IO.dll")
csv_reader_module_2 = FilePath("C:\Users\admin\AppData\Roaming\Grasshopper\Libraries\LumenWorks.Framework.IO.dll")
radar_chart_weights_3 = FilePath(filter_7)
bar_char_indicators = FilePath(filter_8)
amenities_3 = FilePath(filter_6)
filter_15 = StreamFilter(Gate=site, Stream0=csv_reader_module_2, Stream1=csv_reader_module)
button = Button()
csv_reader = PythonScript(
    radar_charts=radar_chart_weights_3,
    amenities=amenities_3,
    bar_charts=bar_char_indicators,
    CSV_reader=filter_15,
    update=button)
# ---------- csv_reader: Python ----------
import scriptcontext as sc
import clr
from System.Reflection import Assembly
assembly = Assembly.LoadFile(CSV_reader)
clr.AddReference(assembly)
import System.IO as io
from LumenWorks.Framework.IO.Csv import CsvReader

if update or sc.sticky["counter"] <= 5:
    sc.sticky["CSV_out"] = []
    radar_read = CsvReader(io.StreamReader(io.FileStream(radar_charts, io.FileMode.Open, io.FileAccess.Read, io.FileShare.ReadWrite)), False)
    amenity_read = CsvReader(io.StreamReader(io.FileStream(amenities, io.FileMode.Open, io.FileAccess.Read, io.FileShare.ReadWrite)), False)
    bar_read = CsvReader(io.StreamReader(io.FileStream(bar_charts, io.FileMode.Open, io.FileAccess.Read, io.FileShare.ReadWrite)), False)
    read_list = [radar_read, amenity_read, bar_read]

    for read in read_list:
        rows = []
        while read.ReadNextRecord():
            row = []
            colCount = read.FieldCount
            print colCount
            for i in range(colCount):
                row.append(read[i])
            rows.append(row)
        read.Close()
        sc.sticky["CSV_out"].append(rows)

parsed_radar = sc.sticky["CSV_out"][0]
parsed_amenity = sc.sticky["CSV_out"][1]
parsed_bar = sc.sticky["CSV_out"][2]
# ---------- end csv_reader ----------
# 1.5 FULL SITE PARSING
_1_5_full_site_parsing = Panel("Meshes")
# 2.1 HEATMAP ANALYSIS
_2_1_excel_parsing = Panel("Meshes")
slider_1_visualization_switch_4 = Integer(slider_1_visualization_switch_2)
full_site_building_heights = Integer(rec_7)
interactive_area_x_offset_2 = Integer(interactive_area_x_offset)
interactive_area_y_offset_2 = Integer(interactive_area_y_offset)
interactive_grid_start_point_2 = Point(interactive_grid_start_point)
full_site_grid_x_extent_3 = Integer(full_site_grid_x_extent_2)
full_site_grid_y_extent_3 = Integer(full_site_grid_y_extent_2)
static = BooleanToggle(False)
grid_x_extent_4 = Integer(grid_x_extent)
grid_y_extent_4 = Integer(grid_y_extent)
quad_cell_size_2 = Number(quad_cell_size)
# 2.1 EXCEL PARSING
_2_1_excel_parsing_2 = Panel("Meshes")
mask_2 = Number(mask)
mask_3 = Integer(mask)
equals_7 = Equality(FirstNumber=rev_3, SecondNumber=0)  # -> Equality, Inequality
python_2 = PythonScript(
    grid_start=interactive_grid_start_point_2,
    cell_size=quad_cell_size_2,
    xe=grid_x_extent_4,
    ye=grid_y_extent_4,
    xe_full=full_site_grid_x_extent_3,
    ye_full=full_site_grid_y_extent_3,
    x_offset=interactive_area_x_offset_2,
    y_offset=interactive_area_y_offset_2,
    mask=mask_3,
    reset=Button())  # -> out, interactive_index, interactive_mask, fullsite_module_centers; inputs mask: list
# ---------- python_2: Python ----------
import scriptcontext as sc
import rhinoscriptsyntax as rs
import Rhino.Geometry as rg

id_start = y_offset * xe_full + x_offset

grid_start_pt = rs.PointCoordinates(grid_start)
grid_start_x = grid_start_pt[0] - (x_offset - 0.5) * cell_size
grid_start_y = grid_start_pt[1] + (y_offset - 0.5) * cell_size


if sc.sticky["counter"] == 0 or reset:
    out_list = []
    point_list = []
    curr_id = id_start
    curr_x = grid_start_x
    curr_y = grid_start_y
    inner_mask = []
    for y in range(ye):
        for x in range(xe):
            out_list.append(curr_id)
            inner_mask.append(mask[curr_id])
            curr_id +=1
        curr_id += xe_full - xe
    for fy in range(ye_full):
        for fx in range(xe_full):
            point_list.append(rg.Point3d(curr_x, curr_y, 0))
            curr_x += cell_size
        curr_y = curr_y - cell_size
        curr_x = grid_start_x

interactive_index = out_list
interactive_mask = inner_mask
fullsite_module_centers = point_list
# ---------- end python_2 ----------
python_3 = PythonScript(inner_mask=python_2.interactive_mask, quad_cell_read=quad_cell_module_id)  # -> out, masked_ID; inputs inner_mask: list of Int32, quad_cell_read: list
# ---------- python_3: Python ----------
masked_ID = list(quad_cell_read)
for i in range(len(inner_mask)):
    if inner_mask[i] == 1:
        print masked_ID[i]
        masked_ID[i] = -1
# ---------- end python_3 ----------

# ---- group: Projection aid
number_slider = Slider(500, range=0..1000)  # disabled
Z_2 = UnitZ(Factor=number_slider)  # disabled
Z_3 = UnitZ(Factor=1)  # disabled
mesh_5 = Mesh(<mesh referenced from the Rhino model>)  # disabled
camera_origin = Point(<point referenced from the Rhino model>)  # disabled
move_5 = Move(Geometry=python_2.fullsite_module_centers, Motion=Z_2)  # -> Geometry, Transform; disabled
neg = Negative(Value=Z_3)  # disabled
project = ProjectPoint(Point=move_5.Geometry, Direction=neg, Geometry=mesh_5)  # -> Point, Index; disabled
meshcp = MeshClosestPoint(Point=project.Point, Mesh=mesh_5)  # -> Point, Index, Parameter; disabled
vec2pt = Vector2Pt(PointA=project.Point, PointB=camera_origin, Unitize=False)  # -> Vector, Length; disabled
xy_2 = XYPlane(Origin=project.Point)  # disabled
meval = MeshEval(Mesh=mesh_5, Parameter=meshcp.Parameter)  # -> Point, Normal, Colour; disabled
pl = PlaneNormal(Origin=project.Point, ZAxis=vec2pt.Vector)  # disabled
orient = Orient(Geometry=xy_2, Source=PlaneXY(0, 0, 0), Target=meval.Normal)  # -> Geometry, Transform; disabled

# ----
barcelona_scores = TargetData(["34583", "25544", "34441", "31943", "33820", "26139", "31017", "31537", "27220", "34038", "23027", "18951", "35193", "34607", "26530", "30389", "28699", "32224", "34440", "29205", "33993", "33546", "34435", "29715"])
volpe_scores = TargetData(["18186", "15444", "21467", "16580", "20667", "11580", "17025", "25908", "16667", "23457", "18398", "9851", "21105", "21428", "18822", "18786", "20262", "19630", "17577", "13680", "15241", "14182", "20270", "21427"])
match = MatchTree()
consideration_range = Slider(200, range=0..300)
dynamid_range = Slider(50, range=0..100)
masked_module_id = Integer(python_3.masked_ID)
dom = ConstructDomain(DomainStart=-1000, DomainEnd=Slider(40000, range=0..100000))
interactive_grid_module_id_to_be_replace = Integer(python_2.interactive_index)  # "interactive grid module ID to be replaced"
masked_module_id_2 = Integer(masked_module_id)
rev_7 = ReverseList(List=rec_5)
mask_4 = Integer(mask)
python_4 = PythonScript(
    mask=mask_4,
    raw_id=rev_7,
    replacement_index=interactive_grid_module_id_to_be_replace,
    replacement_id=masked_module_id_2,
    reset=Button())  # -> out, full_ID, masked_ID; inputs mask: list, raw_id: list, replacement_index: list of Int32, replacement_id: list
# ---------- python_4: Python ----------
import rhinoscriptsyntax as rs
import scriptcontext as sc


if "replaced_ID" not in sc.sticky or reset or sc.sticky["counter"] == 0:
    replacement_dict = {}
    sc.sticky["replaced_ID"] = list(raw_id)
    sc.sticky["masked_ID"] = list(raw_id)
    sc.sticky["mask"] = []
    for i in range(len(mask)):
        if mask[i] == 0:
            sc.sticky["mask"].append(i)
    sc.sticky["negative_mask"] = sorted(set(range(len(mask))).difference(sc.sticky["mask"]))
    for j in range(len(replacement_index)):
        replacement_dict[replacement_index[j]] = j

for index in sc.sticky["mask"]:
    sc.sticky["masked_ID"][index] = -1
    sc.sticky["replaced_ID"][index] = replacement_id[replacement_dict[index]]

full_ID = sc.sticky["replaced_ID"]
masked_ID = sc.sticky["masked_ID"]
# ---------- end python_4 ----------
equals_8 = Equality(FirstNumber=mask_2, SecondNumber=0)  # -> Equality, Inequality
equals_9 = Equality(FirstNumber=mask_2, SecondNumber=0)  # -> Equality, Inequality
equals_10 = Equality(FirstNumber=mask_2, SecondNumber=0)  # -> Equality, Inequality
dispatch = Dispatch(List=full_site_building_heights, DispatchPattern=equals_10.Inequality)  # -> ListA, ListB
counter_6 = Integer(counter)
full_site_module_id = Integer(python_4.full_ID)
full_site_module_id_w_o_interactive_grid = Integer(python_4.masked_ID)  # "full site module ID w/o interactive grid ID->"
full_site_module_center = Point(python_2.fullsite_module_centers)
escaldes_boundary = Curve(<curve referenced from the Rhino model>)
site_mesh = Mesh(<mesh referenced from the Rhino model>)
static_consideration_range_building_heig = Number(dispatch.ListA)  # "static consideration range building heights"
equals_11 = Equality(FirstNumber=counter_6, SecondNumber=0)  # -> Equality, Inequality
filter_16 = StreamFilter(Gate=equals_11.Equality, Stream1=escaldes_boundary)
is_static = Boolean(static)
counter_7 = Integer(counter)
python_5 = PythonScript(toggle=is_static, counter=counter_7)  # -> out, bool
# ---------- python_5: Python ----------
if counter <= 3 or toggle:
    bool = True
else:
    bool = False
# ---------- end python_5 ----------
filter_17 = StreamFilter(Gate=equals_11.Equality, Stream1=escaldes_boundary)
move_6 = Move(Geometry=full_site_module_center, Motion=Vector(0, 0, -200))  # -> Geometry, Transform
site_mesh_2 = Mesh(site_mesh)
meshray = MeshRay(Mesh=site_mesh_2, Point=move_6.Geometry, Direction=Vector(0, 0, 1))  # -> Point, Hit
incurve = PointInCurve(Point=full_site_module_center, Curve=filter_17)  # -> Relationship, Point
pt_14 = Point(meshray.Point)
p_n_c = PickNChoose(Pattern=meshray.Hit, Stream0=full_site_module_center, Stream1=pt_14)
rec_11 = DataRecorder(incurve.Relationship, DataLimit=5760, RecordData=True)
full_site_module_center_2 = Point(p_n_c)
full_site_module_center_3 = Point(full_site_module_center_2)
dispatch_2 = Dispatch(List=full_site_module_center_3, DispatchPattern=equals_7.Equality)  # -> ListA, ListB
lng_3 = ListLength(List=full_site_module_center_3)
cps = ClosestPoints(Point=dispatch_2.ListA, Cloud=full_site_module_center_3, Count=dynamid_range)  # -> ClosestPoint, flatten(CPIndex), Distance
cps_2 = ClosestPoints(Point=dispatch_2.ListA, Cloud=full_site_module_center_3, Count=consideration_range)  # -> ClosestPoint, flatten(CPIndex), Distance
clean = PythonScript(indices=cps.CPIndex, length=lng_3)  # -> out, dynamic_indices; inputs indices: list of Int32, length: Int32
# ---------- clean: Python ----------
import rhinoscriptsyntax as rs
import scriptcontext as sc

from sets import Set
if "dynamic_indices" not in sc.sticky:
    sc.sticky["dynamic_indices"] = []
print len(indices)
if len(indices) > 0:
    reduced_indices = Set()
    for index in indices:
        if index not in reduced_indices:
            reduced_indices.add(index)
    sc.sticky["dynamic_indices"] = list(reduced_indices)

dynamic_indices = sc.sticky["dynamic_indices"]
# ---------- end clean ----------
clean_2 = PythonScript(indices=cps_2.CPIndex, length=lng_3)  # -> out, consideration_indices; inputs indices: list of Int32, length: Int32
# ---------- clean_2: Python ----------
import rhinoscriptsyntax as rs
import scriptcontext as sc

from sets import Set
if "consideration_indices" not in sc.sticky:
    sc.sticky["consideration_indices"] = []
print len(indices)
if len(indices) > 0:
    reduced_indices = Set()
    for index in indices:
        if index not in reduced_indices:
            reduced_indices.add(index)
    sc.sticky["consideration_indices"] = list(reduced_indices)

consideration_indices = sc.sticky["consideration_indices"]
# ---------- end clean_2 ----------
item_16 = ListItem(List=full_site_module_center_3, Index=clean.dynamic_indices, Wrap=True)
item_17 = ListItem(List=full_site_module_center_3, Index=clean_2.consideration_indices, Wrap=True)
cull_i = CullIndex(List=full_site_module_center_3, Indices=clean.dynamic_indices, Wrap=True)
dispatch_3 = Dispatch(List=full_site_module_center_3, DispatchPattern=equals_9.Inequality)  # -> ListA, ListB
static_range_module_center = Point(cull_i)
dynamic_consideration_range_module_cente = Point(item_17)  # "dynamic consideration range module center"
static_consideration_range_module_center = Point(dispatch_3.ListA)
dynamic_range_module_center = Point(item_16)
full_site_module_id_w_o_interactive_grid_2 = Integer(full_site_module_id_w_o_interactive_grid)  # "<- full site module ID w/o interactive grid ID"
full_site_module_id_2 = Integer(full_site_module_id)
full_site_module_id_3 = Integer(full_site_module_id_2)
item_18 = ListItem(List=full_site_module_id_3, Index=clean.dynamic_indices, Wrap=True)
item_19 = ListItem(List=full_site_module_id_3, Index=clean_2.consideration_indices, Wrap=True)
cull_i_2 = CullIndex(List=full_site_module_id_3, Indices=clean.dynamic_indices, Wrap=True)
dispatch_4 = Dispatch(List=full_site_module_id_3, DispatchPattern=equals_8.Inequality)  # -> ListA, ListB
dynamic_range_module_id = Number(item_18)
dynamic_consideration_range_module_id = Number(item_19)
static_range_module_id = Number(cull_i_2)
static_consideration_range_module_id = Number(dispatch_4.ListA)
filter_18 = StreamFilter(Gate=python_5.bool, Stream1=static_consideration_range_building_heig)
filter_19 = StreamFilter(Gate=python_5.bool, Stream0=dynamic_range_module_id, Stream1=static_range_module_id)
filter_20 = StreamFilter(Gate=python_5.bool, Stream0=dynamic_range_module_center, Stream1=static_range_module_center)
filter_21 = StreamFilter(Gate=python_5.bool, Stream0=dynamic_consideration_range_module_id, Stream1=static_consideration_range_module_id)
filter_22 = StreamFilter(Gate=python_5.bool, Stream0=dynamic_consideration_range_module_cente, Stream1=static_consideration_range_module_center)
full_site_building_heights_2 = Integer(rec_7)
number_slider_2 = Slider(12, range=0..100)  # disabled
full_site_module_id_4 = Integer(full_site_module_id_2)
floor_for_each_type_2 = Text(floor_for_each_type)
quad_cell_area_2 = Number(expr("x/4", quad_cell_area))
xy_3 = XYPlane(Origin=full_site_module_center_2)  # disabled
item_20 = ListItem(List=full_site_module_center_2, Index=python_2.interactive_index, Wrap=True)
tag_2 = TextTag3D(Location=xy_3, Text=full_site_module_id_2, Size=number_slider_2, Justification=7)  # disabled
type_ppl_sqm = Panel("""0.01123
0.01818
0.06667
0.0337
0.05454
0.07""")
python_6 = PythonScript(
    escaldes_mask=rec_11,
    ID=full_site_module_id_4,
    bldg_heights=full_site_building_heights_2,
    floor_heights=floor_for_each_type_2,
    floor_area=quad_cell_area_2,
    density=type_ppl_sqm,
    reset=Button())  # -> out, flatten(ppl_flr), flatten(out_sq_ft), flatten(out_population), flatten(out_roadnpark), flatten(in_sq_ft), flatten(in_population), flatten(in_roadnpark); inputs escaldes_mask: list, ID: list of Int32, bldg_heights: list of Int32, floor_heights: list, density: list, reset: Boolean
# ---------- python_6: Python ----------
import rhinoscriptsyntax as rs
import scriptcontext as sc



if sc.sticky["counter"] == 0 or reset:
    out_sets = [[],[0,0,0,0,0,0],[0,0,0,0,0,0],[0,0]]
    out_sets[0] = [(floor_area * density[i]) for i in range(len(density))]
    for i in range(len(ID)):
        if escaldes_mask[i] > 0:
            if 0 <= ID[i] <= 5:
                index = ID[i]
                out_sets[1][index] += floor_area * bldg_heights[i]
                out_sets[2][index] += (floor_area * bldg_heights[i]) * density[index]
            if ID[i] == 6:
                out_sets[3][0] += 1
            if ID[i] == 8:
                out_sets[3][1] += 1

in_sets = [[0,0,0,0,0,0],[0,0,0,0,0,0],[0,0]]

for j in sc.sticky["mask"]:
    if 0 <= ID[j] <= 5:
        index_2 = ID[j]
        in_sets[0][index_2] += floor_area * floor_heights[index_2]
        in_sets[1][index_2] += floor_area * floor_heights[index_2] * density[index_2]
    if ID[j] == 6:
        in_sets[2][0] += 1
    if ID[j] == 8:
        in_sets[2][1] += 1

ppl_flr = out_sets[0]
out_sq_ft = [int(x) for x in out_sets[1]]
out_population = [int(x) for x in out_sets[2]]
out_roadnpark = [int(x) for x in out_sets[3]]
in_sq_ft = [int(x) for x in in_sets[0]]
in_population = [int(x) for x in in_sets[1]]
in_roadnpark = [int(x) for x in in_sets[2]]

#    out_sets_txt_to_save = ""
#    for curr_set in out_sets:
#        out_sets_txt_to_save = out_sets_txt_to_save + ','.join(str(x) for x in curr_set) + "\n"
#    with open(out_sets_txt, "w") as out_sets_txts:
#        out_sets_txts.write(out_sets_txt_to_save)
#    print out_sets_txt_to_save
# ---------- end python_6 ----------
outside_road_n_park_count = Integer(python_6.out_roadnpark)
total_existing_population = Integer(python_6.out_population)
module_center = Point(item_20)
equals_7_2 = PythonScript(slider_1=slider_1_visualization_switch_4)  # -> a
# ---------- equals_7_2: Python ----------
import scriptcontext as sc

if sc.sticky["counter"] <= 3 or slider_1 == 7:
    a = True
else:
    a = False
# ---------- end equals_7_2 ----------
equals_2_2 = PythonScript(slider_1=slider_1_visualization_switch_4)  # -> a
# ---------- equals_2_2: Python ----------
import scriptcontext as sc

if sc.sticky["counter"] <= 3 or slider_1 == 2:
    a = True
else:
    a = False
# ---------- end equals_2_2 ----------
equals_3_2 = PythonScript(slider_1=slider_1_visualization_switch_4)  # -> a
# ---------- equals_3_2: Python ----------
import scriptcontext as sc

if sc.sticky["counter"] <= 3 or slider_1 == 3:
    a = True
else:
    a = False
# ---------- end equals_3_2 ----------
equals_4_2 = PythonScript(slider_1=slider_1_visualization_switch_4)  # -> a
# ---------- equals_4_2: Python ----------
import scriptcontext as sc

if sc.sticky["counter"] <= 3 or slider_1 == 4:
    a = True
else:
    a = False
# ---------- end equals_4_2 ----------
diversity = Text("Diversity")
park_2 = Text("Park")
office = Text("Office")
home = Text("Home")
addition_6 = Addition(A=python_6.out_sq_ft, B=python_6.in_sq_ft)
addition_7 = Addition(A=python_6.out_population, B=python_6.in_population)
total_combined_population = Integer(addition_7)
addition_8 = Addition(A=python_6.out_roadnpark, B=python_6.in_roadnpark)
total_road_n_park_count = Integer(addition_8)
ma = MassAddition(Input=python_6.out_sq_ft)  # -> Result, PartialResults
ma_2 = MassAddition(Input=python_6.in_sq_ft)  # -> Result, PartialResults
ma_3 = MassAddition(Input=addition_6)  # -> Result, PartialResults
ma_4 = MassAddition(Input=python_6.out_population)  # -> Result, PartialResults
ma_5 = MassAddition(Input=python_6.in_population)  # -> Result, PartialResults
ma_6 = MassAddition(Input=addition_7)  # -> Result, PartialResults
cluster = Cluster(G=equals_7_2, _1=filter_20)
# Diversity
filter_23 = StreamFilter(Gate=equals_7_2, Stream1=filter_19)
filter_24 = StreamFilter(Gate=equals_7_2, Stream1=filter_21)
filter_25 = StreamFilter(Gate=equals_7_2, Stream1=filter_22)
filter_26 = StreamFilter(Gate=equals_7_2, Stream1=filter_18)
layers = CreateModifyLayers(LayerName=diversity, Visibility=equals_7_2, DeleteLayer=False, enableFullPath=False)  # -> LayerNames, LayerFullPath
# Proximity (Walkability) to Parks
filter_27 = StreamFilter(Gate=equals_4_2, Stream1=filter_19)
filter_28 = StreamFilter(Gate=equals_4_2, Stream1=filter_20)
filter_29 = StreamFilter(Gate=equals_4_2, Stream1=filter_21)
filter_30 = StreamFilter(Gate=equals_4_2, Stream1=filter_22)
layers_2 = CreateModifyLayers(LayerName=park_2, Visibility=equals_4_2, DeleteLayer=False, enableFullPath=False)  # -> LayerNames, LayerFullPath
# Proximity (Walkability) to Offices
filter_31 = StreamFilter(Gate=equals_2_2, Stream1=filter_19)
filter_32 = StreamFilter(Gate=equals_2_2, Stream1=filter_20)
filter_33 = StreamFilter(Gate=equals_2_2, Stream1=filter_21)
filter_34 = StreamFilter(Gate=equals_2_2, Stream1=filter_22)
# Proximity (Walkability) to Residential
filter_35 = StreamFilter(Gate=equals_3_2, Stream1=filter_19)
filter_36 = StreamFilter(Gate=equals_3_2, Stream1=filter_20)
filter_37 = StreamFilter(Gate=equals_3_2, Stream1=filter_21)
filter_38 = StreamFilter(Gate=equals_3_2, Stream1=filter_22)
layers_3 = CreateModifyLayers(LayerName=office, Visibility=equals_2_2, DeleteLayer=False, enableFullPath=False)  # -> LayerNames, LayerFullPath
layers_4 = CreateModifyLayers(LayerName=home, Visibility=equals_3_2, DeleteLayer=False, enableFullPath=False)  # -> LayerNames, LayerFullPath
panel_31 = Panel(python_6.out_roadnpark)
panel_32 = Panel(addition_8)
panel_33 = Panel(python_6.out_population)
panel_34 = Panel(python_6.in_population)
panel_35 = Panel(addition_7)
panel_36 = Panel(python_6.ppl_flr)
panel_37 = Panel(python_6.out_sq_ft)
panel_38 = Panel(python_6.in_sq_ft)
panel_39 = Panel(addition_6)
all_ids = Panel("""0
1
2
3
4
5
6
7
8
9""")
park_id = Panel("8")
office_ids = Panel("""3
4
5""")
residential_ids = Panel("""0
1
2""")
residential_ids_2 = Panel("""0
1
2""")
office_ids_2 = Panel("""3
4
5""")
all_ids_2 = Panel("""0
1
2
3
4
5
6
7
8
9""")
total_sq_ft = ListItem(List=addition_6, Index=0, Wrap=False)  # -> Item, Item1, Item2, Item3, Item4, Item5
ppl_flr = ListItem(List=python_6.ppl_flr, Index=0, Wrap=False)  # -> Item, Item1, Item2, Item3, Item4, Item5
road_n_park_multiplier = Integer(reverse([ppl_flr.Item1, ppl_flr.Item4]))
multiplication_9 = Multiplication(A=total_road_n_park_count, B=road_n_park_multiplier)
multiplication_10 = Multiplication(A=outside_road_n_park_count, B=road_n_park_multiplier)
merge_5 = Merge(Data1=total_existing_population, Data2=multiplication_10)
merge_6 = Merge(Data1=total_combined_population, Data2=multiplication_9)
radar_excel_parsing = PythonScript(existing_pop=merge_5, new_pop=merge_6, update=button)  # -> out, titles, labels, ext_scores, new_scores; inputs existing_pop: list of Int32, new_pop: list
# ---------- radar_excel_parsing: Python ----------
import scriptcontext as sc

def list_to_tree(input, none_and_holes=True, source=[0]):
    """Transforms nestings of lists or tuples to a Grasshopper DataTree"""
    from Grasshopper import DataTree as Tree
    from Grasshopper.Kernel.Data import GH_Path as Path
    from System import Array
    def proc(input,tree,track):
        path = Path(Array[int](track))
        if len(input) == 0 and none_and_holes: tree.EnsurePath(path); return
        for i,item in enumerate(input):
            if hasattr(item, '__iter__'): #if list or tuple
                track.append(i); proc(item,tree,track); track.pop()
            else:
                if none_and_holes: tree.Insert(item,path,i)
                elif item is not None: tree.Add(item,path)
    if input is not None: t=Tree[object]();proc(input,t,source[:]);
    return t

if sc.sticky["counter"] <= 5 or update:
    read = sc.sticky["CSV_out"][0]
    flip_read = zip(*read)


columns = [8,5,2,19,16,13,25,22,0,1]
rows = ['[2:9]','[10:14]','[15:22]','[23:29]']
ext_scores = [[],[],[],[]]
new_scores = [[],[],[],[]]
labels = []
titles = []

def number_retriever(column, row_str, multiplier):
    sub_column = eval(str(column) + row_str)
    output = ([int(float(x) * multiplier) for x in sub_column])
    return output

def text_retriever(column, row_str):
    sub_column = eval(str(column) + row_str)
    output = [x for x in sub_column]
    return output


for i in range(len(columns)):
    curr_column = flip_read[columns[i]]
    for j in range(len(rows)):
        curr_row = rows[j]
        if 0 <= i < len(existing_pop):
            ext_score = number_retriever(curr_column, curr_row, existing_pop[i])
            new_score = number_retriever(curr_column, curr_row, new_pop[i])
            if len(ext_scores[j]) == 0:
                ext_scores[j].extend(ext_score)
                new_scores[j].extend(new_score)
            else:
                for k in range(len(ext_scores[j])):
                    ext_scores[j][k] += ext_score[k]
                    new_scores[j][k] += new_score[k]
        if i == len(existing_pop):
            titles.append(text_retriever(curr_column, curr_row)[0])
        if i == len(existing_pop)+1:
            labels.append(text_retriever(curr_column, curr_row))

labels = list_to_tree(labels)
ext_scores = list_to_tree(ext_scores)
new_scores = list_to_tree(new_scores)
# ---------- end radar_excel_parsing ----------
all_radar_chart_titles = Text(radar_excel_parsing.labels)
existing_scores = Number(flatten(radar_excel_parsing.ext_scores))
chart_group_titles = Text(radar_excel_parsing.titles)
new_scores = Number(flatten(radar_excel_parsing.new_scores))
barcelona = MatchPaths(
    TargetData=flatten(["34583", "25544", "34441", "31943", "33820", "26139", "31017", "31537", "27220", "34038", "23027", "18951", "35193", "34607", "26530", "30389", "28699", "32224", "34440", "29205", "33993", "33546", "34435", "29715"]),
    SourceData=radar_excel_parsing.ext_scores)  # -> RestructuredData, IndexMap
volpe = MatchPaths(
    TargetData=flatten(["18186", "15444", "21467", "16580", "20667", "11580", "17025", "25908", "16667", "23457", "18398", "9851", "21105", "21428", "18822", "18786", "20262", "19630", "17577", "13680", "15241", "14182", "20270", "21427"]),
    SourceData=radar_excel_parsing.ext_scores)  # -> RestructuredData, IndexMap
entwine = Entwine(Branch0X=existing_scores, Branch1X=new_scores, Branch2X=barcelona_scores, FlattenInputs=False)
barcelona_2 = Panel(radar_excel_parsing.labels)
remap = RemapNumbers(Value=entwine, Source=dom, Target=Domain(0, 1))  # -> simplify(Mapped), Clipped
bang = ExplodeTree(Data=remap.Mapped)  # -> Branch0, Branch1, Branch2
map = MatchPaths(TargetData=flatten(bang.Branch0), SourceData=radar_excel_parsing.ext_scores)  # -> RestructuredData, IndexMap
map_2 = MatchPaths(TargetData=flatten(bang.Branch1), SourceData=radar_excel_parsing.ext_scores)  # -> RestructuredData, IndexMap
map_3 = MatchPaths(TargetData=flatten(bang.Branch2), SourceData=radar_excel_parsing.ext_scores)  # -> RestructuredData, IndexMap
barcelona_3 = Panel(barcelona.RestructuredData)
volpe_2 = Panel(volpe.RestructuredData)
existing = Panel(radar_excel_parsing.ext_scores)
barcelona_remapped = Number(map_3.RestructuredData)
proposed_remapped = Number(map_2.RestructuredData)
existing_remapped = Number(map.RestructuredData)
proposed = Panel(radar_excel_parsing.new_scores)
bar_excel_parsing = PythonScript(existing=existing_remapped, proposed=proposed_remapped, barcelona=barcelona_remapped, update=button)  # -> out, ext_scores, new_scores, barca_scores; inputs existing: tree, proposed: tree, barcelona: tree
# ---------- bar_excel_parsing: Python ----------
import scriptcontext as sc

if sc.sticky["counter"] <= 5 or update:
    read = sc.sticky["CSV_out"][2]
    flip_read = zip(*read)


columns = [2,6,10,14,18,22]
rows = ['[2:9]','[10:14]','[15:22]','[23:29]']
scores_in = [existing, proposed, barcelona]
scores_out = [[],[],[]]

def score_retriever(curr_column, next_column, row_str, score_in):
    a = eval(str(curr_column) + row_str)
    output = sum([float(a[i]) / 200 * score_in[i] for i in range(len(score_in))])
    return output

for h in range(len(scores_in)):
    for i in range(len(columns)):
        total_score = 0
        curr_column = flip_read[columns[i]]
        next_column = flip_read[columns[i]+1]
        for j in range(len(rows)):
            curr_row = rows[j]
            curr_score = list(scores_in[h].Branch(j))
            curr_sum = score_retriever(curr_column, next_column, curr_row, curr_score)
            total_score += curr_sum
        scores_out[h].append(total_score)

ext_scores = scores_out[0]
new_scores = scores_out[1]
barca_scores = scores_out[2]
# ---------- end bar_excel_parsing ----------
outside_sq_ft = ListItem(List=python_6.out_sq_ft, Index=0, Wrap=False)  # -> Item, Item1, Item2, Item3, Item4, Item5
inside_sq_ft = ListItem(List=python_6.in_sq_ft, Index=0, Wrap=False)  # -> Item, Item1, Item2, Item3, Item4, Item5
outside_population = ListItem(List=python_6.out_population, Index=0, Wrap=False)  # -> Item, Item1, Item2, Item3, Item4, Item5
inside_population = ListItem(List=python_6.in_population, Index=0, Wrap=False)  # -> Item, Item1, Item2, Item3, Item4, Item5
total_population = ListItem(List=addition_7, Index=0, Wrap=False)  # -> Item, Item1, Item2, Item3, Item4, Item5
R = MassAddition(Input=[total_population.Item, total_population.Item1, total_population.Item2])  # -> Result, PartialResults
O = MassAddition(Input=[total_population.Item3, total_population.Item4, total_population.Item5])  # -> Result, PartialResults
python_7 = PythonScript(
    search_module_IDs=filter_27,
    search_module_centers=filter_28,
    consideration_module_IDs=filter_29,
    consideration_module_centers=filter_30,
    ID_to_search=park_id,
    ID_to_search_from=all_ids)  # -> out, simplify(search_from), search_cloud; inputs search_module_IDs: list, search_module_centers: list of Point3d, consideration_module_IDs: list of Int32, consideration_module_centers: list of Point3d, ID_to_search: list of Int32, ID_to_search_from: list of Int32
# ---------- python_7: Python ----------
import rhinoscriptsyntax as rs
import scriptcontext as sc
search_from = []
search_cloud = []
for i in range(len(search_module_IDs)):
    if search_module_IDs[i] in ID_to_search_from:
        search_from.append(search_module_centers[i])
for j in range(len(consideration_module_IDs)):
    if consideration_module_IDs[j] in ID_to_search:
        search_cloud.append(consideration_module_centers[j])
# ---------- end python_7 ----------
python_8 = PythonScript(
    search_module_IDs=filter_31,
    search_module_centers=filter_32,
    consideration_module_IDs=filter_33,
    consideration_module_centers=filter_34,
    ID_to_search=office_ids,
    ID_to_search_from=residential_ids)  # -> out, simplify(search_from), search_cloud; inputs search_module_IDs: list, search_module_centers: list of Point3d, consideration_module_IDs: list of Int32, consideration_module_centers: list of Point3d, ID_to_search: list of Int32, ID_to_search_from: list of Int32; same code as python_7
python_9 = PythonScript(
    search_module_IDs=filter_35,
    search_module_centers=filter_36,
    consideration_module_IDs=filter_37,
    consideration_module_centers=filter_38,
    ID_to_search=residential_ids_2,
    ID_to_search_from=office_ids_2)  # -> out, simplify(search_from), search_cloud; inputs search_module_IDs: list, search_module_centers: list of Point3d, consideration_module_IDs: list of Int32, consideration_module_centers: list of Point3d, ID_to_search: list of Int32, ID_to_search_from: list of Int32; same code as python_7
python_10 = PythonScript(
    search_module_IDs=filter_23,
    search_module_centers=cluster,
    consideration_module_IDs=filter_24,
    consideration_module_centers=filter_25,
    consideration_bldg_heights=filter_26,
    ID_to_search=[park_id, all_ids_2],
    ID_to_search_from=all_ids_2)  # -> out, simplify(search_from), search_cloud, search_cloud_IDs, search_cloud_bldg_heights; inputs search_module_IDs: list, search_module_centers: list of Point3d, consideration_module_IDs: list of Int32, consideration_module_centers: list of Point3d, consideration_bldg_heights: list of Int32, ID_to_search: list of Int32, ID_to_search_from: list of Int32
# ---------- python_10: Python ----------
import rhinoscriptsyntax as rs
import scriptcontext as sc
search_from = []
search_cloud = []
search_cloud_IDs = []

if len(consideration_bldg_heights) > 0:
    search_cloud_bldg_heights = []
for i in range(len(search_module_IDs)):
    if search_module_IDs[i] in ID_to_search_from:
        search_from.append(search_module_centers[i])
for j in range(len(consideration_module_IDs)):
    if consideration_module_IDs[j] in ID_to_search:
        search_cloud.append(consideration_module_centers[j])
        search_cloud_IDs.append(consideration_module_IDs[j])
        if len(consideration_bldg_heights) > 0:
            search_cloud_bldg_heights.append(consideration_bldg_heights[j])
# ---------- end python_10 ----------
influence_range_count = Slider(25, range=1..80)
influence_range_count_2 = Slider(30, range=1..80)
influence_range_count_3 = Slider(30, range=1..80)
total_interactive_area_population = Integer(ma_5.Result)
total_combined_r_population = Integer(R.Result)
total_combined_o_population = Integer(O.Result)
total_combined_population_2 = Integer(ma_6.Result)
total_combined_population_3 = Integer(total_combined_population_2)
total_outside_population = Integer(ma_4.Result)
total_outside_population_2 = Integer(total_outside_population)
amenity_excel_parsing = PythonScript(existing=total_outside_population_2, proposed=total_combined_population_3, update=button)  # -> out, flatten(amenity_names), flatten(amenity_existing), flatten(amenity_needed)
# ---------- amenity_excel_parsing: Python ----------
import scriptcontext as sc

if sc.sticky["counter"] <= 5 or update:
    read = sc.sticky["CSV_out"][1]
    flip_read = zip(*read)

amenity_names = list(flip_read[0])[1:]
amenity_ratio = list(flip_read[1])[1:]
amenity_existing = [int(existing / float(amenity_ratio[i])) for i in range(len(amenity_ratio))]
amenity_needed = [int(proposed / float(amenity_ratio[i])) for i in range(len(amenity_ratio))]
# ---------- end amenity_excel_parsing ----------
panel_40 = Panel(amenity_excel_parsing.amenity_names)
panel_41 = Panel(amenity_excel_parsing.amenity_needed)
amenities_existing = Integer(amenity_excel_parsing.amenity_existing)
amenities_needed = Integer(amenity_excel_parsing.amenity_needed)
amenity_names = Text(amenity_excel_parsing.amenity_names)
influence_range = Slider(25, range=1..80)
cps_3 = ClosestPoints(Point=python_7.search_from, Cloud=python_7.search_cloud, Count=influence_range_count)  # -> ClosestPoint, CPIndex, Distance
cps_4 = ClosestPoints(Point=python_8.search_from, Cloud=python_8.search_cloud, Count=influence_range_count_2)  # -> ClosestPoint, CPIndex, Distance
cps_5 = ClosestPoints(Point=python_9.search_from, Cloud=python_9.search_cloud, Count=influence_range_count_3)  # -> ClosestPoint, CPIndex, Distance
ma_7 = MassAddition(Input=cps_3.Distance)  # -> Result, PartialResults
ma_8 = MassAddition(Input=cps_4.Distance)  # -> Result, PartialResults
ma_9 = MassAddition(Input=cps_5.Distance)  # -> Result, PartialResults
cps_6 = ClosestPoints(Point=python_10.search_from, Cloud=python_10.search_cloud, Count=influence_range)  # -> ClosestPoint, CPIndex, Distance
pshift_17 = ShiftPaths(Data=ma_7.Result, Offset=-2)
pshift_18 = ShiftPaths(Data=ma_8.Result, Offset=-2)
pshift_19 = ShiftPaths(Data=ma_9.Result, Offset=-2)
floor_per_type = Text(floor_for_each_type)
one_over_x = OneOverX(Value=pshift_17)
ppl_per_floor = Number(python_6.ppl_flr)
one_over_x_2 = OneOverX(Value=pshift_18)
one_over_x_3 = OneOverX(Value=pshift_19)
item_21 = ListItem(List=python_10.search_cloud_IDs, Index=cps_6.CPIndex, Wrap=True)
item_22 = ListItem(List=python_10.search_cloud_bldg_heights, Index=cps_6.CPIndex, Wrap=True)
is_static_2 = Boolean(static)
total_interactive_area_population_2 = Integer(total_interactive_area_population)
proximity_score = Number(one_over_x)
proximity_score_2 = Number(one_over_x_2)
proximity_score_3 = Number(one_over_x_3)
neighborhood_population = PythonScript(
    neighbor_IDs=item_21,
    neighbor_heights=item_22,
    ppl_per_floor=ppl_per_floor,
    floor_numbers=floor_per_type,
    is_static=is_static_2)  # -> out, simplify(population); inputs neighbor_IDs: tree of Int32, neighbor_heights: tree of Int32, ppl_per_floor: list, floor_numbers: list of Int32, is_static: Boolean
# ---------- neighborhood_population: Python ----------
import rhinoscriptsyntax as rs
import scriptcontext as sc
from Grasshopper import DataTree as Tree
from Grasshopper.Kernel.Data import GH_Path as Path
from Grasshopper.Kernel import GH_Document as GH_doc
from System import Array

def list_to_tree(input, none_and_holes=True, source=[0]):
    """Transforms nestings of lists or tuples to a Grasshopper DataTree"""
    def proc(input,tree,track):
        path = Path(Array[int](track))
        if len(input) == 0 and none_and_holes: tree.EnsurePath(path); return
        for i,item in enumerate(input):
            if hasattr(item, '__iter__'): #if list or tuple
                track.append(i); proc(item,tree,track); track.pop()
            else:
                if none_and_holes: tree.Insert(item,path,i)
                elif item is not None: tree.Add(item,path)
    if input is not None: t=Tree[object]();proc(input,t,source[:]);return t

def people_counter(neighbor_IDs, ppl_per_floor, floor_numbers):
    people_counts_out = []
    for i in range(neighbor_IDs.BranchCount):
        floor_counts = [0,0,0,0,0,0]
        neighbors = list(neighbor_IDs.Branch(i))
        if is_static:
            neighbor_height = list(neighbor_heights.Branch(i))
        for j in range(len(neighbors)):
            if 0 <= neighbors[j] <= 5:
                if is_static:
                    curr_floor_height = neighbor_height[j]
                else:
                    curr_floor_height = floor_numbers[neighbors[j]]
                floor_counts[neighbors[j]] = floor_counts[neighbors[j]] + curr_floor_height
        people_counts = []
        for k in range(len(floor_counts)):
            curr_type_population = int(abs(floor_counts[k] * ppl_per_floor[k]))
            people_counts.append(curr_type_population)
        people_counts_out.append(people_counts)
    return people_counts_out

population_counts = people_counter(neighbor_IDs, ppl_per_floor, floor_numbers)
population = list_to_tree(population_counts)
# ---------- end neighborhood_population ----------
bnd = Bounds(Numbers=proximity_score_3)
bnd_2 = Bounds(Numbers=proximity_score)
bnd_3 = Bounds(Numbers=proximity_score_2)
filter_39 = StreamFilter(Gate=python_5.bool, Stream1=bnd)
filter_40 = StreamFilter(Gate=python_5.bool, Stream1=bnd_2)
filter_41 = StreamFilter(Gate=python_5.bool, Stream1=bnd_3)
diversity_calculation = PythonScript(population=neighborhood_population.population)  # -> out, res_diversity_scores, off_diversity_scores, res_to_off_diversity_scores, total_pop; inputs population: tree of Int32
# ---------- diversity_calculation: Python ----------
import rhinoscriptsyntax as rs
import scriptcontext as sc
import math

def diversity(population):
    res_diversity_set = []
    off_diversity_set = []
    res_to_off_diversity_set = []
    total_pop_set = []
    for i in range(population.BranchCount):
        curr_set = list(population.Branch(i))
        for j in range(len(curr_set)):
            if curr_set[j] == 0:
                curr_set[j] = 1
        R_total = sum(curr_set[0:3])
        O_total = sum(curr_set[3:])
        total_pop = R_total + O_total
        RL_perc = curr_set[0] / R_total
        RM_perc = curr_set[1] / R_total
        RS_perc = curr_set[2] / R_total
        OL_perc = curr_set[3] / O_total
        OM_perc = curr_set[4] / O_total
        OS_perc = curr_set[5] / O_total
        R_perc = R_total / total_pop
        O_perc = O_total / total_pop
        res_diversity = (RL_perc * math.log10(RL_perc) + RM_perc * math.log10(RM_perc) + RS_perc * math.log10(RS_perc)) / math.log10(3) * (-1)
        off_diversity = (OL_perc * math.log10(OL_perc) + OM_perc * math.log10(OM_perc) + OS_perc * math.log10(OS_perc)) / math.log10(3) * (-1)
        res_to_off_diversity = (R_perc * math.log10(R_perc) + O_perc * math.log10(O_perc)) / math.log10(2) * (-1)
        scores = [res_diversity, off_diversity, res_to_off_diversity]
        for k in range(len(scores)):
            if scores[k] >= 0.99999:
                scores[k] = 0
        res_diversity_set.append(scores[0])
        off_diversity_set.append(scores[1])
        res_to_off_diversity_set.append(scores[2])
        total_pop_set.append(total_pop)
    return [res_diversity_set, off_diversity_set, res_to_off_diversity_set,total_pop_set]

diversities = diversity(population)
res_diversity_scores = diversities[0]
off_diversity_scores = diversities[1]
res_to_off_diversity_scores = diversities[2]
total_pop = diversities[3]
# ---------- end diversity_calculation ----------
rec_12 = DataRecorder(filter_39, DataLimit=1, RecordData=True)
rec_13 = DataRecorder(filter_40, DataLimit=1, RecordData=True)
rec_14 = DataRecorder(filter_41, DataLimit=1, RecordData=True)
panel_43 = Panel(bnd_3)
panel_44 = Panel(rec_14)
panel_45 = Panel(rec_12)
panel_46 = Panel(bnd)
panel_47 = Panel(rec_13)
panel_48 = Panel(bnd_2)
bnd_4 = Bounds(Numbers=diversity_calculation.res_diversity_scores)
bnd_5 = Bounds(Numbers=diversity_calculation.off_diversity_scores)
bnd_6 = Bounds(Numbers=diversity_calculation.res_to_off_diversity_scores)
bnd_7 = Bounds(Numbers=diversity_calculation.total_pop)
dedomain = DeconstructDomain(Domain=bnd_7)  # -> Start, End
dedomain_2 = DeconstructDomain(Domain=panel_45)  # -> Start, End
dedomain_3 = DeconstructDomain(Domain=panel_47)  # -> Start, End
dedomain_4 = DeconstructDomain(Domain=panel_44)  # -> Start, End
res_div = RemapNumbers(Value=diversity_calculation.res_diversity_scores, Source=bnd_4, Target=Domain(0, 1))  # -> expr("x * 0.4", graft(Mapped)), Clipped
off_div = RemapNumbers(Value=diversity_calculation.off_diversity_scores, Source=bnd_5, Target=Domain(0, 1))  # -> expr("x * 0.4", graft(Mapped)), Clipped
res_to_off = RemapNumbers(Value=diversity_calculation.res_to_off_diversity_scores, Source=bnd_6, Target=Domain(0, 1))  # -> expr("x* 0.1", graft(Mapped)), Clipped
density = RemapNumbers(Value=diversity_calculation.total_pop, Source=bnd_7, Target=Domain(0, 1))  # -> expr("x* 0.4", Mapped), Clipped
division_5 = Division(A=dedomain_2.Start, B=Slider(1, range=0.99..1))
multiplication_11 = Multiplication(A=dedomain_2.End, B=Slider(1, range=0..1))
division_6 = Division(A=dedomain_3.Start, B=Slider(1, range=0.99..1))
multiplication_12 = Multiplication(A=dedomain_3.End, B=Slider(1, range=0..1))
division_7 = Division(A=dedomain_4.Start, B=Slider(1, range=0.99..1))
multiplication_13 = Multiplication(A=dedomain_4.End, B=Slider(1, range=0..1))
dom_2 = ConstructDomain(DomainStart=division_5, DomainEnd=multiplication_11)
dom_3 = ConstructDomain(DomainStart=division_6, DomainEnd=multiplication_12)
dom_4 = ConstructDomain(DomainStart=division_7, DomainEnd=multiplication_13)
ma_10 = MassAddition(Input=[res_div.Mapped, off_div.Mapped, res_to_off.Mapped])  # -> flatten(Result), PartialResults
remap_2 = RemapNumbers(Value=proximity_score_2, Source=dom_4, Target=Domain(0, 1))  # -> Mapped, Clipped
remap_3 = RemapNumbers(Value=proximity_score_3, Source=dom_2, Target=Domain(0, 1))  # -> Mapped, Clipped
remap_4 = RemapNumbers(Value=proximity_score, Source=dom_3, Target=Domain(0, 1))  # -> Mapped, Clipped
multiplication_14 = Multiplication(A=ma_10.Result, B=1.2)
mask_5 = Number(mask)
addition_9 = Addition(A=multiplication_14, B=density.Mapped)

equals_12 = Equality(FirstNumber=mask_5, SecondNumber="1")  # -> Equality, Inequality
equals_13 = Equality(FirstNumber=mask_5, SecondNumber="0")  # -> Equality, Inequality
or = GateOr(A=equals_13.Equality, B=equals_12.Equality)
full_site_module_center_4 = Point(full_site_module_center_2)  # disabled
full_site_module_id_5 = Integer(full_site_module_id)
number_slider_3 = Slider(16, range=0..100)  # disabled
# 2.2 SENDING DATA TO UNITY
# 2.2 Sending data to Unity: Send JSON file of current (interactive) state via HTTP post
dispatch_5 = Dispatch(List=full_site_module_center_4, DispatchPattern=or)  # -> ListA, ListB; disabled
dispatch_6 = Dispatch(List=full_site_module_id_5, DispatchPattern=or)  # -> ListA, ListB
xy_4 = XYPlane(Origin=dispatch_5.ListA)  # disabled
grid_with_interactive_area = Integer(flatten(dispatch_6.ListA))
tag_3 = TextTag3D(Location=xy_4, Text=dispatch_6.ListA, Size=number_slider_3, Justification=7)  # disabled

remap_5 = RemapNumbers(Value=addition_9, Source=Domain(0, 1), Target=Domain(0, 1))  # -> Mapped, Clipped
heatmap_module_centers = Point(flatten([python_10.search_from, python_7.search_from, python_9.search_from, python_8.search_from]))
heatmap_normalized_values = Number(flatten([remap_4.Mapped, remap_3.Mapped, remap_2.Mapped, remap_5.Mapped]))
number_slider_4 = Slider(0, range=0..100)
slider_1_visualization_switch_5 = Integer(slider_1_visualization_switch_2)
masked_module_id_3 = Integer(masked_module_id)
dock_rotation_2 = Integer(pshift_11)
grid_x_extent_5 = Integer(grid_x_extent)
grid_y_extent_5 = Integer(grid_y_extent)
rotation_3 = Integer(rotation_2)
dock_id_4 = Integer(pshift_10)
X = Integer(x)
Y = Integer(y)
subtraction = Subtraction(A=grid_x_extent_5, B=1)
x_2 = Integer(X)
subtraction_2 = Subtraction(A=subtraction, B=x_2)
slider1 = Text(flatten(slider_1_visualization_switch_5))
rotation_4 = Text(rotation_3)
dockid = Text(dock_id_4)
module_id_2 = Text(grid_with_interactive_area)
txt_3 = Text(subtraction_2)
txt_4 = Text(Y)
toggle1 = Integer(number_slider_4)
int_5 = Integer(number_slider_4)
int_6 = Integer(number_slider_4)
int_7 = Integer(number_slider_4)
dock_rotation_3 = Text(dock_rotation_2)
floor_per_type_2 = Text(floor_for_each_type)
txt_5 = Text(toggle1)
txt_6 = Text(int_5)
txt_7 = Text(int_6)
txt_8 = Text(int_7)
lng_4 = ListLength(List=module_id_2)
repeat_5 = RepeatData(Data="{\"type\":", Length=lng_4)
repeat_6 = RepeatData(Data=",\"x\":", Length=lng_4)
repeat_7 = RepeatData(Data=",\"y\":", Length=lng_4)
repeat_8 = RepeatData(Data=",\"rot\":", Length=lng_4)
repeat_9 = RepeatData(Data="}", Length=lng_4)
join_3 = TextJoin(Text=floor_per_type_2, Join=",")
pshift_20 = ShiftPaths(Data=repeat_5, Offset=-1)
pshift_21 = ShiftPaths(Data=repeat_6, Offset=-1)
pshift_22 = ShiftPaths(Data=repeat_7, Offset=-1)
pshift_23 = ShiftPaths(Data=repeat_8, Offset=-1)
pshift_24 = ShiftPaths(Data=repeat_9, Offset=-1)
pshift_25 = ShiftPaths(Data=join_3, Offset=-1)
merge_7 = Merge(
    Data1=graft(pshift_20),
    Data2=graft(module_id_2),
    Data3=graft(pshift_21),
    Data4=graft(txt_3),
    Data5=graft(pshift_22),
    Data6=graft(txt_4),
    Data7=graft(pshift_23),
    Data8=graft(rotation_4),
    Data9=graft(pshift_24))
join_4 = TextJoin(Text=merge_7)
pshift_26 = ShiftPaths(Data=join_4, Offset=-1)
txt_9 = Text(pshift_26)
join_5 = TextJoin(Text=txt_9, Join=",")
txt_10 = Text(join_5)
merge_8 = Merge(
    Data1="{\"grid\":[",
    Data2=txt_10,
    Data3="],\"objects\":{",
    Data4="\"slider1\":",
    Data5=slider1,
    Data6=",\"toggle1\":",
    Data7=txt_5,
    Data8=",\"toggle2\":",
    Data9=txt_6,
    Data10=",\"toggle3\":",
    Data11=txt_7,
    Data12=",\"toggle4\":",
    Data13=txt_8,
    Data14=",\"dockID\":",
    Data15=dockid,
    Data16=",\"dockRotation\":",
    Data17=dock_rotation_3,
    Data18=",\"IDMax\":15",
    Data19=",\"density\":[",
    Data20=pshift_25,
    Data21="],\"pop_young\":0,\"pop_mid\":0,\"pop_old\":0",
    Data22="}",
    Data23="}")
join_6 = TextJoin(Text=merge_8)
is_local = BooleanToggle(True)
txt_11 = Text(join_6)
panel_49 = Panel(txt_11)
python_11 = PythonScript(flag=is_local, remote="https://cityio.media.mit.edu", local="http://localhost:8080")  # -> out, server
# ---------- python_11: Python ----------
if flag :
    server = local
else:
    server = remote
# ---------- end python_11 ----------
dam = DataDam(DataA=txt_11, BufferDelay=20000000, BufferMode=2)
send_table_data = PythonScript(url=python_11.server, path="api/table/update/citymatrix_andorra", jsonString=dam)  # -> out
# ---------- send_table_data: Python ----------
import System 
import System.Net 
import System.Uri
import System.IO
import System.Text.Encoding
import json


def postTable(url,stringData,debug=True):
    webclient = System.Net.WebClient()
    webclient.Headers['Content-type'] = 'text/plain'
    
    if debug:
        
        # simple validation before we send
        try:
            json.loads(stringData)
        except:
            print 'invalid string, revise your string data'
            return
        
        # this will block your process
        data = System.Text.Encoding.Default.GetBytes(stringData)
        webclient.UploadData(url,'POST',data)
        
    else:
        data = System.Text.Encoding.Default.GetBytes(stringData)
        webclient.UploadDataAsync(url,'POST',data)

endpoint = System.Uri('{}/{}'.format(url,path))



postTable(endpoint,jsonString, False)
# rhino crashes using async callbacks,
# so try the following if something is wrong
# postData(endpoint,jsonString,debug=True)
# ---------- end send_table_data ----------

# ---- group: heat map mesh z position
# HEATMAP OUTPUT
number_slider_5 = Slider(2.2, range=0..10)

# ----
slider_1_visualization_switch_6 = Integer(slider_1_visualization_switch_2)
module_type_reference_mesh_origin_1_or_7_2 = Mesh(module_type_reference_mesh_origin_1_or_7)
module_type_reference_mesh_origin_0_to_5_2 = Mesh(module_type_reference_mesh_origin_0_to_5)
total_interactive_area_population_3 = Integer(total_interactive_area_population)
slider_1_visualization_switch_7 = Integer(slider_1_visualization_switch_2)
slider_1_visualization_switch_8 = Integer(slider_1_visualization_switch_2)
slider_1_visualization_switch_9 = Integer(slider_1_visualization_switch_2)
heatmap_normalized_values_2 = Number(heatmap_normalized_values)
# 3.1 interactive site 2D matrix
# 3.1 Full site 2D city matrix: 2D visualization of bricks (buildings and roads) for the entire site.
interactive_grid_start_point_3 = Point(interactive_grid_start_point)
heatmap_module_centers_2 = Point(heatmap_module_centers)
cell_size_reference_point_2 = Point(cell_size_reference_point)
cell_size_shrink_factor_3 = Number(cell_size_shrink_factor)
masked_module_id_4 = Integer(masked_module_id)
module_center_2 = Point(module_center)
heatmap_mesh_z = Number(number_slider_5)
quad_cell_size_3 = Number(quad_cell_size)
grid_x_extent_6 = Integer(grid_x_extent)
quad_cell_size_4 = Number(quad_cell_size)
grid_y_extent_6 = Integer(grid_y_extent)
module_id_3 = Integer(quad_cell_module_id)
rotation_5 = Integer(rotation_2)
equals_14 = Equality(FirstNumber=slider_1_visualization_switch_6, SecondNumber=9)  # -> Equality, Inequality
X_2 = Integer(x)
Y_2 = Integer(y)
module_type_reference_mesh_origin_0_to_5_3 = Mesh(move_4)
reference_module_scale = Slider(1.2, range=0..4)
# 3.1 full site 2D matrix
# 3.1 Full site 2D city matrix: 2D visualization of bricks (buildings and roads) for the entire site.
satellite_image_file_path_3 = FilePath(filter_4)
satellite_image_boundary = Curve(<curve referenced from the Rhino model>)
# 3.3 HEATMAP VISUALIZATION
_2_1_excel_parsing_3 = Panel("Meshes")
# DEMOGRAPHICS
offset_amount = Slider(65, range=0..100)
# 3.1 people dot display
panel_50 = Panel("0.5 to 3.0")
panel_51 = Panel("""Large Office Units
30 m² / person, executives""")
panel_52 = Panel("""Large Residential Units
89 m² / person, executives""")
panel_53 = Panel("""Medium Residential Units
55 m² / person, mid-career""")
panel_54 = Panel("""Small Residential Units
15 m² / person, millenials""")
panel_55 = Panel("""Medium Office Units
18 m² / person, mid-career""")
panel_56 = Panel("""Small Office Unit
5 m² / person, millenials""")
number_offset = Slider(130, range=0..300)
text_size = Slider(12, range=0..100)
# 3.1 satellite image
# Satellite image: Background image for when no other visualizations are visible
site_mesh_3 = Mesh(site_mesh)
# AMENITIES
amenities_reference_pt = Point(<point referenced from the Rhino model>)
existing_amenities = Integer(amenities_existing)
required_amenities = Integer(amenities_needed)
barcelona_amenities = Integer([19, 122, 83, 50, 36, 60, 27, 4, 25, 20, 13, 21, 1, 2])
# BAR CHART
number_slider_6 = Slider(300, range=0..500)
number_slider_7 = Slider(15, range=0..200)
bar_gap = Slider(95, range=0..200)
quad_cell_area_3 = Number(expr("x/4", quad_cell_area))
amenity_names_2 = Text(amenity_names)
interactive_sqm = Integer(python_6.in_sq_ft)
bars_reference_pt = Point(<point referenced from the Rhino model>)
total_out_sqm = Integer(python_6.out_sq_ft)
panel_57 = Panel("""ANDORRA
(CURRENT)""")
escaldes_sqm = Integer(python_6.out_sq_ft)
panel_58 = Panel("""3RD PLACES /
AMENITIES""")
panel_59 = Panel("""ANDORRA
(NEW)""")
# 2.3 GRAPH DISPLAY
# 2.2 Sending data to Unity: Send JSON file of current (interactive) state via HTTP post
number_slider_8 = Slider(50, range=0..50)
barcelona_bar_remapped = Number(bar_excel_parsing.barca_scores)
proposed_bar_remapped = Number(bar_excel_parsing.new_scores)
total_sqm = Integer(addition_6)
existing_bar_remapped = Number(bar_excel_parsing.ext_scores)
number_slider_9 = Slider(1, range=0..10)
total_combined_population_4 = Integer(total_combined_population_2)
panel_60 = Panel("""Building
Energy""")
panel_61 = Panel("""Mobility
Energy""")
panel_62 = Panel("""Innovation
Potential""")
panel_63 = Panel("""Safety &
Security""")
panel_64 = Panel("""Social
Wellbeing""")
panel_65 = Panel("""Developer
Profits""")
remap_6 = RemapNumbers(Value=total_interactive_area_population_3, Source="100 to 3000", Target=panel_50)  # -> Mapped, Clipped
equals_15 = Equality(FirstNumber=slider_1_visualization_switch_7, SecondNumber=0)  # -> Equality, Inequality
chart_ref_pt = Point(<point referenced from the Rhino model>)
series_7 = Series(Start=0, Step=expr("-x", offset_amount), Count=6)
integer_division = IntegerDivision(A=escaldes_sqm, B=quad_cell_area_3)
integer_division_2 = IntegerDivision(A=total_sqm, B=quad_cell_area_3)
split_6 = SplitList(List=total_sqm, Index=3)  # -> ListA, ListB
integer_division_3 = IntegerDivision(A=interactive_sqm, B=quad_cell_area_3)  # -> graft(Result)
entwine_2 = Entwine(
    Branch00=panel_52,
    Branch01=panel_53,
    Branch02=panel_54,
    Branch03=panel_51,
    Branch04=panel_55,
    Branch05=panel_56,
    FlattenInputs=True)
filter_42 = StreamFilter(Gate=equals_15.Equality, Stream1=site_mesh_3)
scale_nu = ScaleNU(
    Geometry=module_type_reference_mesh_origin_0_to_5_3,
    Plane=PlaneXY(0, 0, 0),
    ScaleX=reference_module_scale,
    ScaleY=reference_module_scale,
    ScaleZ=1)  # -> Geometry, Transform
txt_12 = Text(graft(["+ ", "+ ", "+ ", "+ ", "+ ", "+ "]))

# ---- group: total number control
num = Number(remap_6.Mapped)

# ----
txt_13 = Text([panel_60, panel_61, panel_62, panel_63, panel_64, panel_65])
division_8 = Division(A=1, B=number_slider_8)
entwine_3 = Entwine(Branch00=existing_bar_remapped, Branch01=proposed_bar_remapped, Branch02=barcelona_bar_remapped, FlattenInputs=True)  # -> simplify(Result)
line = LineSDL(Start=chart_ref_pt, Direction=Vector(0, 1, 0), Length=number_slider_6)
series_8 = Series(Start=0, Step=bar_gap, Count=6)
dom_5 = ConstructDomain(DomainStart=Slider(0.1, range=0..1), DomainEnd=Slider(0.9, range=0..1))
merge_9 = Merge(Data1=panel_57, Data2=existing_amenities)
merge_10 = Merge(Data1="BARCELONA", Data2=barcelona_amenities)
merge_11 = Merge(Data1=panel_59, Data2=required_amenities)
series_9 = Series(Start=190, Step=number_offset, Count=3)
merge_12 = Merge(Data1=panel_58, Data2=amenity_names_2)
J = Join("")
txt_14 = Text(graft(integer_division))
ma_11 = MassAddition(Input=split_6.ListA)  # -> Result, PartialResults
ma_12 = MassAddition(Input=split_6.ListB)  # -> Result, PartialResults
num_2 = Number(0)
txt_15 = Text(graft(integer_division_2))
Y_3 = UnitY(Factor=series_7)
series_10 = Series(Start=0, Step=division_8, Count=expr("x+1", number_slider_8))
equals_16 = Equality(FirstNumber=slider_1_visualization_switch_9, SecondNumber=9)  # -> Equality, Inequality
multiplication_15 = Multiplication(A="20000", B=number_slider_9)
multiplication_16 = Multiplication(A="0", B=number_slider_9)
txt_16 = Text(entwine_2)
X_3 = UnitX(Factor=series_8)
filter_43 = StreamFilter(Gate=slider_1_visualization_switch_8, Stream1=filter_19)
join_7 = TextJoin(Text=[txt_12, integer_division_3])
X_4 = UnitX(Factor=flatten([num_2, series_9]))
move_7 = Move(Geometry=bars_reference_pt, Motion=Y_3)  # -> Geometry, Transform
join_8 = TextJoin(Text=merge_10, Join=J)
remap_7 = RemapNumbers(Value=entwine_3, Source=dom_5, Target=Domain(0, 1))  # -> Mapped, Clipped
join_9 = TextJoin(Text=merge_9, Join=J)
join_10 = TextJoin(Text=merge_12)
join_11 = TextJoin(Text=merge_11, Join=J)
pt_15 = Point(Point(0, 0, 0))
max = Maximum(A=ma_11.Result, B=ma_12.Result)
panel_66 = Panel(max)

# ---- group: attractor pt - red line station
pt_16 = Point(<point referenced from the Rhino model>)

# ----
item_23 = ListItem(List=txt_16, Index=0, Wrap=True)  # -> Item, Item1
dom_6 = ConstructDomain(DomainStart=multiplication_16, DomainEnd=multiplication_15)
move_8 = Move(Geometry=line, Motion=X_3)  # -> Geometry, Transform
previewmat = CustomPreviewMaterials(
    Geometry=filter_42,
    DiffuseColor=ColourSwatch(SwatchColor=RGB(255, 255, 255)),
    Transparency=0,
    DiffuseBitmap=satellite_image_file_path_3)
flip_3 = FlipMatrix(Data=remap_7.Mapped)
vec2pt_2 = Vector2Pt(PointA=pt_15, PointB=move_7.Geometry, Unitize=False)  # -> Vector, Length
move_9 = Move(Geometry=graft(move_7.Geometry), Motion=[Vector(35, 18, 0), Vector(35, -4, 0)])  # -> Geometry, Transform
move_10 = Move(Geometry=graft(move_7.Geometry), Motion=[Vector(-75, 0, 0), Vector(-35, 10, 0), Vector(-35, -10, 0)])  # -> Geometry, Transform
move_11 = Move(Geometry=amenities_reference_pt, Motion=X_4)  # -> Geometry, Transform
dynamic_range_module_center_2 = Point(filter_20)
barcelona_4 = ColourSwatch(SwatchColor=RGBA(59, 255, 91, 136))
label = ColourSwatch(SwatchColor=RGBA(191, 191, 191, 175))
current_site = ColourSwatch(SwatchColor=RGBA(93, 127, 153, 175))
new_site = ColourSwatch(SwatchColor=RGBA(140, 191, 230, 175))
merge_13 = Merge(Data1=join_7, Data2=txt_15, Data3=txt_14)
entwine_4 = Entwine(Branch00=total_sqm, Branch01=total_out_sqm, FlattenInputs=True)
dynamic_range_module_id_2 = Number(filter_43)
item_24 = ListItem(List=move_7.Geometry, Index=-2, Wrap=True)  # -> Item, Item1, Item2
labels = Text([join_10, join_9, join_11, join_8])
dom_7 = ConstructDomain(DomainStart=0, DomainEnd=Slider(700000, range=0..800000))

# ---- group: traffic mode is PEV
bool = Boolean(equals_16.Equality)

# ----
join_12 = TextJoin(Text=item_23.Item, Join=" ")
eval = EvaluateCurve(Curve=reparameterize(graft(move_8.Geometry)), Parameter=flip_3)  # -> Point, Tangent, Angle
domain = Domain(dom_6)

# ---- group: total ppl #
int_8 = Integer(total_combined_population_4)

# ----
X_5 = UnitX(Factor=expr("-x", number_slider_7))
floor_per_type_3 = Text(floor_for_each_type)
X_6 = UnitX(Factor=number_slider_7)
remap_8 = RemapNumbers(Value=entwine_4, Source=dom_7, Target=Domain(0, 1))  # -> simplify(Mapped), Clipped
ln_2 = Line(StartPoint=item_24.Item1, EndPoint=item_24.Item2)
text_1 = ColourSwatch(SwatchColor=RGB(191, 191, 191))
text_2 = ColourSwatch(SwatchColor=RGB(128, 128, 128))
module_type_reference_mesh_origin_0_to_5_4 = Mesh(module_type_reference_mesh_origin_0_to_5)
panel_67 = Panel(int_8)
full_site_module_id_w_o_interactive_grid_3 = Integer(full_site_module_id_w_o_interactive_grid_2)  # "<- full site module ID w/o interactive grid ID"
amenities_labels = TextTag3D(
    Location=move_11.Geometry,
    Text=labels,
    Size=text_size,
    Colour=[label, current_site, new_site, barcelona_4],
    Justification=7)
move_12 = Move(Geometry=move_8.Geometry, Motion=X_6)  # -> Geometry, Transform
move_13 = Move(Geometry=move_8.Geometry, Motion=X_5)  # -> Geometry, Transform
equals_17 = Equality(FirstNumber=masked_module_id_4, SecondNumber="-1")  # -> Equality, Inequality
larger = LargerThan(FirstNumber=masked_module_id_4, SecondNumber="0")  # -> LargerThan, OrEqualTo
smaller = SmallerThan(FirstNumber=masked_module_id_4, SecondNumber="5")  # -> SmallerThan, OrEqualTo
equals_18 = Equality(FirstNumber=masked_module_id_4, SecondNumber="7")  # -> Equality, Inequality
move_14 = Move(Geometry=eval.Point, Motion=X_5)  # -> Geometry, Transform
move_15 = Move(Geometry=eval.Point, Motion=X_6)  # -> Geometry, Transform
move_16 = Move(Geometry=graft([ln_2, item_24.Item1]), Motion=[Vector(350, -20, 0), Vector(420, -20, 0)])  # -> simplify(Geometry), Transform
split_7 = SplitList(List=remap_8.Mapped, Index=3)  # -> reverse(ListA), reverse(ListB)
move_17 = Move(Geometry=scale_nu.Geometry, Motion=vec2pt_2.Vector)  # -> Geometry, Transform
tag_4 = TextTag3D(Location=move_9.Geometry, Text=[join_12, item_23.Item1], Size=12, Colour=[text_1, text_2], Justification=1)
full_site_module_center_5 = Point(full_site_module_center_2)
tag_5 = TextTag3D(
    Location=move_10.Geometry,
    Text=merge_13,
    Size=[20, 12, 12],
    Colour=[ColourSwatch(SwatchColor=RGB(230, 230, 230)), ColourSwatch(SwatchColor=RGB(191, 191, 191)), ColourSwatch(SwatchColor=RGB(128, 128, 128))],
    Justification=6)
full_site_grid_x_extent_4 = Integer(full_site_grid_x_extent_2)
full_site_grid_y_extent_4 = Integer(full_site_grid_y_extent_2)
cell_size_shrink_factor_4 = Number(cell_size_shrink_factor)
remap_9 = RemapNumbers(Value=int_8, Source=domain, Target=Domain(0.3, 1))  # -> Mapped, Clipped
remap_10 = RemapNumbers(Value=int_8, Source=domain, Target=Domain(0, 0.5))  # -> Mapped, Clipped
multiplication_17 = Multiplication(A=bool, B="-0.7")
full_site_module_id_6 = Integer(full_site_module_id)
and_2 = GateAnd(A=larger.OrEqualTo, B=smaller.OrEqualTo)
ln_3 = Line(StartPoint=move_15.Geometry, EndPoint=move_14.Geometry)  # -> simplify(Line)
bang_2 = ExplodeTree(Data=move_16.Geometry)  # -> Branch0, Branch1
toggle = BooleanToggle(True)
python_12 = PythonScript(r_n=split_7.ListA, o_n=split_7.ListB)  # -> out, r_crv, r_end, o_crv, o_end; inputs r_n: tree, o_n: tree
# ---------- python_12: Python ----------
import Rhino.Geometry as rg

def list_to_tree(input, none_and_holes=True, source=[0]):
    """Transforms nestings of lists or tuples to a Grasshopper DataTree"""
    from Grasshopper import DataTree as Tree
    from Grasshopper.Kernel.Data import GH_Path as Path
    from System import Array
    def proc(input,tree,track):
        path = Path(Array[int](track))
        if len(input) == 0 and none_and_holes: tree.EnsurePath(path); return
        for i,item in enumerate(input):
            if hasattr(item, '__iter__'): #if list or tuple
                track.append(i); proc(item,tree,track); track.pop()
            else:
                if none_and_holes: tree.Insert(item,path,i)
                elif item is not None: tree.Add(item,path)
    if input is not None: t=Tree[object]();proc(input,t,source[:]);
    return t

def get_domain(params):
    out = []
    curr_param = 0
    for param in params:
        domain_start = curr_param
        curr_param += param
        out.append(rg.Interval(domain_start, curr_param))
    return out, curr_param

rp_n = []
op_n = []
r_end = []
o_end = []
for i in range(r_n.BranchCount):
    r_set = get_domain(r_n.Branch(i))
    o_set = get_domain(o_n.Branch(i))
    rp_n.append(r_set[0])
    r_end.append(r_set[1])
    op_n.append(o_set[0])
    o_end.append(o_set[1])

print rp_n[0]

r_crv = list_to_tree(rp_n)
o_crv = list_to_tree(op_n)
# ---------- end python_12 ----------
full_site_x = Integer([0, 1, 2, 3, 4, 5, 6, 7, 8, 9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])
full_site_y = Integer([0, 0, 0, 0, 0, 0, 0, 0, 0, 0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])
panel_68 = Panel(python_6.ppl_flr)
mask_6 = Integer(mask)

vec = VectorXYZ(XComponent=-5, YComponent=5, ZComponent=0)  # -> Vector, Length
vec_2 = VectorXYZ(XComponent=-5, YComponent=5, ZComponent=0)  # -> Vector, Length
vec_3 = VectorXYZ(XComponent=5, YComponent=5, ZComponent=0)  # -> Vector, Length
vec_4 = VectorXYZ(XComponent=0, YComponent=-5, ZComponent=0)  # -> Vector, Length
series_11 = Series(Start=0, Step=1, Count=5760)
index = Integer(series_11)  # disabled
move_18 = Move(Geometry=full_site_module_center_5, Motion=vec_2.Vector)  # -> Geometry, Transform; disabled
move_19 = Move(Geometry=full_site_module_center_5, Motion=vec_3.Vector)  # -> Geometry, Transform; disabled
move_20 = Move(Geometry=full_site_module_center_5, Motion=vec_4.Vector)  # -> Geometry, Transform; disabled
move_21 = Move(Geometry=full_site_module_center_5, Motion=vec.Vector)  # -> Geometry, Transform; disabled
mask_7 = JustifiedText3d(
    Location=move_18.Geometry,
    Text=mask_6,
    Size=10,
    Color=ColourSwatch(SwatchColor=RGB(0, 106, 255)),
    HorizontalAlignment=1,
    VerticalAlginment=1,
    UseMeshes=False,
    Bake=False)  # disabled
id = JustifiedText3d(
    Location=move_19.Geometry,
    Text=full_site_module_id_6,
    Size=10,
    Color=ColourSwatch(SwatchColor=RGB(25, 255, 0)),
    HorizontalAlignment=1,
    VerticalAlginment=1,
    UseMeshes=False,
    Bake=False)  # disabled
bldg_height = JustifiedText3d(
    Location=move_21.Geometry,
    Text=full_site_building_heights_2,
    Size=10,
    Color=ColourSwatch(SwatchColor=RGB(255, 0, 174)),
    HorizontalAlignment=1,
    VerticalAlginment=1,
    UseMeshes=False,
    Bake=False)  # disabled
index_2 = JustifiedText3d(
    Location=move_20.Geometry,
    Text=index,
    Size=7,
    Color=ColourSwatch(SwatchColor=RGB(255, 0, 0)),
    HorizontalAlignment=1,
    VerticalAlginment=1,
    UseMeshes=False,
    Bake=False)  # disabled

eval_2 = EvaluateCurve(Curve=reparameterize(graft(move_8.Geometry)), Parameter=0)  # -> Point, Tangent, Angle
eval_3 = EvaluateCurve(Curve=reparameterize(graft(move_8.Geometry)), Parameter=1)  # -> Point, Tangent, Angle
dispatch_7 = Dispatch(List=module_center_2, DispatchPattern=equals_17.Equality)  # -> ListA, ListB
dispatch_8 = Dispatch(List=masked_module_id_4, DispatchPattern=and_2)  # -> ListA, ListB
dispatch_9 = Dispatch(List=module_center_2, DispatchPattern=equals_18.Equality)  # -> ListA, ListB
move_22 = Move(Geometry=graft(bang_2.Branch0), Motion=[Vector(-20, 0, 0), Vector(-40, 0, 0)])  # -> simplify(Geometry), Transform
scale = Scale(Geometry=ln_3, Center=eval.Point, Factor=1.2)  # -> Geometry, Transform
item_25 = ListItem(List=flip_3, Index=1, Wrap=True)
larger_2 = LargerThan(FirstNumber=series_10, SecondNumber=item_25)  # -> LargerThan, OrEqualTo
dispatch_10 = Dispatch(List=series_10, DispatchPattern=larger_2.LargerThan)  # -> ListA, ListB
eval_4 = EvaluateCurve(Curve=reparameterize(graft(move_8.Geometry)), Parameter=dispatch_10.ListA)  # -> Point, Tangent, Angle
move_23 = Move(Geometry=eval_4.Point, Motion=X_6)  # -> Geometry, Transform
move_24 = Move(Geometry=eval_4.Point, Motion=X_5)  # -> Geometry, Transform
ln_4 = Line(StartPoint=move_23.Geometry, EndPoint=move_24.Geometry)  # -> simplify(Line)
item_26 = ListItem(List=ln_3, Index=1, Wrap=True)
item_27 = ListItem(List=eval.Point, Index=1, Wrap=True)
Z_4 = UnitZ(Factor=heatmap_mesh_z)
division_9 = Division(A=quad_cell_size_4, B=2)
entwine_5 = Entwine(Branch0X=python_12.r_crv, Branch1X=python_12.o_crv, FlattenInputs=False)  # -> simplify(Result)
entwine_6 = Entwine(Branch00=python_12.r_end, Branch01=python_12.o_end, FlattenInputs=True)  # -> simplify(Result)
item_28 = ListItem(List=module_type_reference_mesh_origin_0_to_5_2, Index=graft(dispatch_8.ListA), Wrap=True)
visualization_switch = StreamFilter(
    Gate=slider_1_visualization_switch_7,
    Stream1=module_type_reference_mesh_origin_0_to_5_4,
    Stream6=module_type_reference_mesh_origin_0_to_5_4)
visualization_switch_2 = StreamFilter(
    Gate=slider_1_visualization_switch_7,
    Stream1=full_site_module_center_5,
    Stream8=full_site_module_center_5,
    Stream9=full_site_module_center_5)
building_population_calc = PythonScript(
    floor_heights=floor_per_type_3,
    ppl_per_flr=panel_68,
    module_centers=dynamic_range_module_center_2,
    module_IDs=dynamic_range_module_id_2,
    reduction_amount=Slider(0.1, range=0..1))  # -> out, L_base_planes, M_base_planes, S_base_planes, L_angles, M_angles, S_angles, L_radii, M_radii, S_radii; inputs floor_heights: list of Int32, ppl_per_flr: list, module_centers: list of Point3d, module_IDs: list of Int32
# ---------- building_population_calc: Python ----------
import rhinoscriptsyntax as rs
import scriptcontext as sc
import random
from math import pi


def list_to_tree(input, none_and_holes=True, source=[0]):
    """Transforms nestings of lists or tuples to a Grasshopper DataTree"""
    from Grasshopper import DataTree as Tree
    from Grasshopper.Kernel.Data import GH_Path as Path
    from System import Array
    def proc(input,tree,track):
        path = Path(Array[int](track))
        if len(input) == 0 and none_and_holes: tree.EnsurePath(path); return
        for i,item in enumerate(input):
            if hasattr(item, '__iter__'): #if list or tuple
                track.append(i); proc(item,tree,track); track.pop()
            else:
                if none_and_holes: tree.Insert(item,path,i)
                elif item is not None: tree.Add(item,path)
    if input is not None: t=Tree[object]();proc(input,t,source[:]);
    return t


base_planes = [[],[],[]]
angles = [[],[],[]]
radii = [[],[],[]]

for i in range(len(module_IDs)):
    if 0 <= module_IDs[i] <= 5:
        curr_ID = module_IDs[i]
        curr_plane = rs.PlaneFromFrame(module_centers[i], (1,0,0), (0,1,0))
        curr_pop = int(floor_heights[curr_ID] * ppl_per_flr[curr_ID] * reduction_amount)
        curr_radius = []
        curr_angle = []
        for j in range(curr_pop):
            curr_angle.append(random.uniform(0, 2*pi))
            curr_radius.append(random.random())
        if curr_ID < 3:
            base_planes[curr_ID].append(curr_plane)
            angles[curr_ID].append(curr_angle)
            radii[curr_ID].append(curr_radius)
        else:
            base_planes[curr_ID - 3].append(curr_plane)
            angles[curr_ID - 3].append(curr_angle)
            radii[curr_ID - 3].append(curr_radius)

L_base_planes = list_to_tree(base_planes[0])
M_base_planes = list_to_tree(base_planes[1])
S_base_planes = list_to_tree(base_planes[2])
L_angles = list_to_tree(angles[0])
M_angles = list_to_tree(angles[1])
S_angles = list_to_tree(angles[2])
L_radii = list_to_tree(radii[0])
M_radii = list_to_tree(radii[1])
S_radii = list_to_tree(radii[2])
# ---------- end building_population_calc ----------
move_25 = Move(Geometry=scale.Geometry, Motion=Vector(0, 0, 1))  # -> Geometry, Transform
gradient = Gradient(
    LowerLimit=0,
    UpperLimit=1,
    Parameter=item_25,
    stops=[0.344: RGB(255, 0, 0), 0.497: RGB(255, 255, 0), 0.652: RGB(0, 128, 0)])
vec2pt_3 = Vector2Pt(PointA=item_27, PointB=eval_2.Point, Unitize=False)  # -> Vector, Length
move_26 = Move(Geometry=heatmap_module_centers_2, Motion=Z_4)  # -> Geometry, Transform
gradient_2 = Gradient(
    LowerLimit=0,
    UpperLimit=1,
    Parameter=heatmap_normalized_values_2,
    stops=[0: RGB(255, 0, 0), 0.499: RGB(255, 255, 0), 1: RGB(0, 128, 0)])
neg_2 = Negative(Value=division_9)
move_27 = Move(Geometry=eval_3.Point, Motion=Vector(-20, 60, 0))  # -> flatten(Geometry), Transform
subcrv = SubCurve(BaseCurve=graft(move_22.Geometry), Domain=entwine_5)
path_mapper = PathMapper(subcrv, source="{A;B}", target="{B}")
eval_5 = EvaluateCurve(Curve=move_22.Geometry, Parameter=entwine_6)  # -> Point, Tangent, Angle
remap_11 = RemapNumbers(Value=entwine_6, Source=Domain(0, 1), Target=dom_7)  # -> Mapped, Clipped
dispatch_11 = Dispatch(List=rotation_5, DispatchPattern=and_2)  # -> ListA, ListB
pshift_27 = ShiftPaths(Data=item_28, Offset=-1)
extr = Extrude(Base=item_26, Direction=vec2pt_3.Vector)
vec2pt_4 = Vector2Pt(PointA=Point(0, 0, 0), PointB=move_26.Geometry, Unitize=False)  # -> Vector, Length
pt_17 = ConstructPoint(XCoordinate=0, YCoordinate=0, ZCoordinate=0)
dom_8 = ConstructDomain(DomainStart=neg_2, DomainEnd=division_9)
move_28 = Move(Geometry=eval_5.Point, Motion=simplify(Vector(0, 5, 0)))  # -> Geometry, Transform
eval_6 = Evaluate(F="format(\"{0}K m²\", int(x/1000))", x=remap_11.Mapped)  # -> simplify(r)
cluster_2 = Cluster_2(scale_factor=cell_size_shrink_factor_4, is_pev=Toggle(False))  # -> roads_c_2, centerpoint_c_2, roads_o_2, centerpoint_o_2, centerline_2, centerpoint_x_2

# ---- group: heatmap opacity
number_slider_10 = Slider(0.67, range=0..1)

# ----
panel_69 = Panel("0")  # disabled
panel_70 = Panel("5")
planesrf = PlaneSurface(Plane=pt_17, XSize=dom_8, YSize=dom_8)
rotate = Rotate(Geometry=pshift_27, Angle=degrees(dispatch_11.ListA), Plane=PlaneXY(0, 0, 0))  # -> Geometry, Transform
dispatch_12 = Dispatch(List=module_center_2, DispatchPattern=and_2)  # -> ListA, ListB

# ---- group: module center - 0 to 5
pt_18 = Point(dispatch_12.ListA)

# ----
dist_2 = Distance(PointA=pt_18, PointB=pt_16)
one_over_x_4 = OneOverX(Value=dist_2)
bnd_8 = Bounds(Numbers=one_over_x_4)
remap_12 = RemapNumbers(Value=one_over_x_4, Source=bnd_8, Target=Domain(0, 1))  # -> Mapped, Clipped
graph = GraphMapper(
    remap_12.Mapped,
    x0=0,
    x1=1,
    y0=0,
    y1=1,
    container_name="Bezier",
    cpx=[0, 0.02228338085, 0.545909524, 1],
    cpy=[0, 0.3859086633, 0.9269992113, 0.9974365234])
lng_5 = ListLength(List=dist_2)
random = Random(Range=Domain(0, 1), Number=lng_5, Seed=25)
multiplication_18 = Multiplication(A=graph, B=num)
smaller_2 = SmallerThan(FirstNumber=random, SecondNumber=multiplication_18)  # -> SmallerThan, OrEqualTo

# ---- group: pop or not
bool_2 = Boolean(smaller_2.OrEqualTo)

# ---- group: 3rd Places Icons: Restaurant, Grocery, Hotel
mesh_6 = Mesh([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])

# ----
barcelona_5 = ColourSwatch(SwatchColor=RGBA(58, 255, 91, 136))
current_site_2 = ColourSwatch(SwatchColor=RGBA(93, 127, 153, 175))
new_site_2 = ColourSwatch(SwatchColor=RGBA(140, 191, 230, 175))
bang_3 = ExplodeTree(Data=subcrv)  # -> Branch0, Branch1, Branch2, Branch3
prot = RotatePlane(Plane=bang_2.Branch1, Angle=degrees(90))
move_29 = Move(Geometry=flatten([ln_4, move_12.Geometry, move_13.Geometry]), Motion=expr("-x", Vector(0, 0, 1)))  # -> Geometry, Transform
prot_2 = RotatePlane(Plane=move_28.Geometry, Angle=degrees(90))  # -> simplify(Plane)
movetoorgin = MoveToOrgin(G=mesh_6, num=Slider(0.48, range=0..1))
dispatch_13 = Dispatch(List=pt_18, DispatchPattern=bool_2)  # -> ListA, ListB
scale_nu_2 = ScaleNU(Geometry=planesrf, Plane=PlaneXY(0, 0, 0), ScaleX=1, ScaleY=1, ScaleZ=1)  # -> Geometry, Transform

# ---- group: balance two colors
number_slider_11 = Slider(0.8, range=0..1)

# ----
label_2 = ColourSwatch(SwatchColor=RGBA(191, 191, 191, 175))
vec2pt_5 = Vector2Pt(PointA=Point(0, 0, 0), PointB=dispatch_12.ListA, Unitize=False)  # -> Vector, Length
vec2pt_6 = Vector2Pt(PointA=Point(0, 0, 0), PointB=dispatch_7.ListA, Unitize=False)  # -> Vector, Length
vec2pt_7 = Vector2Pt(PointA=Point(0, 0, 0), PointB=dispatch_9.ListA, Unitize=False)  # -> Vector, Length
X_7 = UnitX(Factor=-10)
X_8 = UnitX(Factor=-15)
argb_3 = SplitARGB(Colour=gradient_2)  # -> Alpha, Red, Green, Blue
col_4 = Colour([current_site_2, new_site_2, barcelona_5])
python_13 = PythonScript(ids=full_site_module_id_w_o_interactive_grid_3)  # -> out, equals_blank, equals_module; inputs ids: list of Int32; disabled
# ---------- python_13: Python ----------
equals_blank = []
equals_module = []

for i in range(len(ids)):
    if ids[i] == -1:
        equals_blank.append(True)
        equals_module.append(False)
    elif 0 <= ids[i] <= 5:
        equals_blank.append(False)
        equals_module.append(True)
    else:
        equals_blank.append(False)
        equals_module.append(False)
# ---------- end python_13 ----------
extr_2 = Extrude(Base=[bang_3.Branch1, bang_3.Branch3], Direction=simplify(X_7))
python_14 = PythonScript(
    xe=full_site_grid_x_extent_4,
    ye=full_site_grid_y_extent_4,
    id=full_site_module_id_6,
    mask=mask_6,
    pt=full_site_module_center_5,
    roads_c=cluster_2.roads_c_2,
    centerpoint_c=cluster_2.centerpoint_c_2,
    roads_o=cluster_2.roads_o_2,
    centerpoint_o=cluster_2.centerpoint_o_2,
    centerline=cluster_2.centerline_2,
    centerpoint_x=cluster_2.centerpoint_x_2,
    reset=Button())  # -> out, rdType, flatten(Roads_In), flatten(Roads_Buffer), flatten(Roads_Out), flatten(Centerlines_In), flatten(Centerpoints_In), flatten(Centerlines_Buffer)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; inputs xe: Int32, ye: Int32, id: list of Int32, mask: list of Int32, pt: list, roads_c: list, roads_o: list, centerline: list
# ---------- python_14: Python ----------
import rhinoscriptsyntax as rs
import scriptcontext as sc



def list_to_tree(input, none_and_holes=True, source=[0]):
    """Transforms nestings of lists or tuples to a Grasshopper DataTree"""
    from Grasshopper import DataTree as Tree
    from Grasshopper.Kernel.Data import GH_Path as Path
    from System import Array
    def proc(input,tree,track):
        path = Path(Array[int](track))
        if len(input) == 0 and none_and_holes: tree.EnsurePath(path); return
        for i,item in enumerate(input):
            if hasattr(item, '__iter__'): #if list or tuple
                track.append(i); proc(item,tree,track); track.pop()
            else:
                if none_and_holes: tree.Insert(item,path,i)
                elif item is not None: tree.Add(item,path)
    if input is not None: t=Tree[object]();proc(input,t,source[:]);
    return t

def neighbors(n):
    out = [-1,-1,-1,-1] #bottom, right, top, left
    if n > xe : #top
        out[2] = n - xe
    if n < xe * (ye - 1): #bottom
        out[0] = n + xe
    if n % xe != 0: #left
        out[3] = n - 1
    if n % xe != xe - 1: #right
        out[1] = n + 1
    return out

def road_type(n, neighbor):
    road_types = []
    for i in range(len(neighbor)):
        if neighbor[i] == -1:
            road_types.append(1)
        else:
            if id[neighbor[i]] == 6:
                road_types.append(1)
            else:
                road_types.append(0)
    return road_types

def is_intersection(road_types):
    if sum(road_types) > 2:
        return True

def place_road(n, road_types):
    pt_to = rs.PointCoordinates(pt[n])
    road_out = []
    centerline_out = []
    centerpoint_out = []
    for i in range(len(road_types)):
        if road_types[i] == 0:
            road_from = rs.PointCoordinates(centerpoint_c)
            road_ref = roads_c
        if road_types[i] == 1:
            road_from = rs.PointCoordinates(centerpoint_o)
            road_ref = roads_o
            centerline_from = rs.PointCoordinates(centerpoint_x)
            vx_2 = pt_to[0] - centerline_from[0]
            vy_2 = pt_to[1] - centerline_from[1]
            vz_2 = pt_to[2] - centerline_from[2]
            centerline_out.append(rs.CopyObject(centerline[i], (vx_2, vy_2, vz_2)))
            centerpoint_out.append(pt[n])
        vx = pt_to[0] - road_from[0]
        vy = pt_to[1] - road_from[1]
        vz = pt_to[2]
        road_out.append(rs.CopyObject(road_ref[i], (vx,vy,vz)))
    return [road_out, centerline_out, centerpoint_out]

if "road_mask" not in sc.sticky or reset:
    sc.sticky["road_mask"] = set()

ax = set(range(len(id)))

if sc.sticky["counter"] == 0 or reset:
    for index in sc.sticky["mask"]:
        curr_neighbor = neighbors(index)
        sc.sticky["road_mask"] |= set(curr_neighbor)
    road_mask_negative = sorted(set(range(len(mask))).difference(sc.sticky["road_mask"]))
    rd = []
    cl = []
    cp = []
    intersection = []
    for j in road_mask_negative:
        if id[j] == 6:
            out_neighbor = neighbors(j)
            out_road_types = road_type(j, out_neighbor)
            if is_intersection(out_road_types):
                intersection.append(pt[j])
            rd.extend(place_road(j, out_road_types)[0])
            cl.extend(place_road(j, out_road_types)[1])
            cp.extend(place_road(j, out_road_types)[2])
    Roads_Out = rd
    Centerlines_Out = cl
    Intersections_Out = intersection
    Centerpoints_Out = cp

Roads_In = []
Centerlines_In = []
Centerpoints_In = []
Intersections_In = []
Roads_Buffer = []
Centerlines_Buffer = []
Centerpoints_Buffer = []

for index in sorted(sc.sticky["road_mask"]):
    if id[index] == 6:
        curr_neighbor = neighbors(index)
        curr_road_types = road_type(index, curr_neighbor)
        curr_road_outputs = place_road(index, curr_road_types)
        if is_intersection(curr_road_types):
            Intersections_In.append(pt[index])
        if mask[index] == 0:
            Roads_In.extend(curr_road_outputs[0])
            Centerlines_In.extend(curr_road_outputs[1])
            Centerpoints_In.extend(curr_road_outputs[2])
        if mask[index] != 0:
            Roads_Buffer.extend(curr_road_outputs[0])
            Centerlines_Buffer.extend(curr_road_outputs[1])
            Centerpoints_Buffer.extend(curr_road_outputs[2])
# ---------- end python_14 ----------
extr_3 = Extrude(Base=[bang_3.Branch0, bang_3.Branch2], Direction=simplify(X_8))

# ---- group: Mesh at Orgin to Copy
mesh_7 = Mesh(scale_nu_2.Geometry)

# ----
move_30 = Move(Geometry=module_type_reference_mesh_origin_1_or_7_2, Motion=vec2pt_6.Vector)  # -> Geometry, Transform
move_31 = Move(Geometry=rotate.Geometry, Motion=vec2pt_5.Vector)  # -> Geometry, Transform
move_32 = Move(Geometry=module_type_reference_mesh_origin_1_or_7_2, Motion=vec2pt_7.Vector)  # -> Geometry, Transform

# ---- group: module center - popped 3rd places
pt_19 = Point(dispatch_13.ListA)

# ---- group: module meshes lego at orgin
mesh_8 = Mesh(movetoorgin)

# ----
tag_6 = TextTag3D(Location=flatten(move_27.Geometry), Text=flatten(txt_13), Size=13, Colour=label_2, Justification=1)
preview_9 = CustomPreview(Geometry=flatten(move_29.Geometry), Shader=ColourSwatch(SwatchColor=RGBA(48, 48, 48, 71)))
text_2_2 = ColourSwatch(SwatchColor=RGB(191, 191, 191))
text_2_3 = ColourSwatch(SwatchColor=RGB(191, 191, 191))
road_2 = ColourSwatch(SwatchColor=RGB(64, 64, 64))
subtraction_3 = Subtraction(A=1, B=number_slider_11)
previewlw = CustomPreviewLineweights(Geometry=move_25.Geometry, Shader=col_4, Thickness=2, Absolute=True)
panel_71 = Panel("""LIVE
WORK""")
preview_10 = CustomPreview(Geometry=extr, Shader=gradient)
multiplication_19 = Multiplication(A=number_slider_10, B=argb_3.Alpha)
frgb_5 = ColourRGBF(Alpha=multiplication_19, Red=argb_3.Red, Green=argb_3.Green, Blue=argb_3.Blue)
dispatch_14 = Dispatch(List=full_site_module_id_w_o_interactive_grid_3, DispatchPattern=python_13.equals_module)  # -> ListA, ListB
graph_2 = GraphMapper(
    building_population_calc.M_radii,
    x0=0,
    x1=1,
    y0=0,
    y1=1,
    container_name="Bezier",
    cpx=[0, 0.3430397809, 1, 1],
    cpy=[0, 0.5653408766, 0.3680863976, 1])
graph_3 = GraphMapper(
    building_population_calc.L_radii,
    x0=0,
    x1=1,
    y0=0,
    y1=1,
    container_name="Bezier",
    cpx=[0, 0.3011363745, 1, 1],
    cpy=[0, 0.7926136255, 0.5111194849, 1])
graph_4 = GraphMapper(
    building_population_calc.S_radii,
    x0=0,
    x1=1,
    y0=0,
    y1=1,
    container_name="Bezier",
    cpx=[0, 0.2763824463, 1, 1],
    cpy=[0, 0.2786865234, 0.3680863976, 1])
move_33 = Move(Geometry=mesh_7, Motion=vec2pt_4.Vector)  # -> Geometry, Transform
polygon = Polygon(Plane="0,0,4", Radius=Slider(1.5, range=0..10), Segments=Slider(9, range=0..10), FilletRadius=0)  # -> Polygon, Length
dom_9 = ConstructDomain(DomainStart=0, DomainEnd=Slider(200, range=0..500))
dom_10 = ConstructDomain(DomainStart=0, DomainEnd=Slider(75, range=0..500))
dom_11 = ConstructDomain(DomainStart=0, DomainEnd=Slider(120, range=0..500))
preview_11 = CustomPreview(
    Geometry=extr_2,
    Shader=reverse([ColourSwatch(SwatchColor=RGB(191, 191, 191)), ColourSwatch(SwatchColor=RGB(128, 128, 128)), ColourSwatch(SwatchColor=RGB(64, 64, 64))]))
preview_12 = CustomPreview(
    Geometry=extr_3,
    Shader=reverse([ColourSwatch(SwatchColor=RGB(255, 122, 122)), ColourSwatch(SwatchColor=RGB(196, 156, 100)), ColourSwatch(SwatchColor=RGB(0, 123, 255))]))
tag_7 = TextTag3D(Location=prot_2, Text=eval_6, Size=8, Colour=text_2_2, Justification=7)
Z_5 = UnitZ(Factor=0.1)
Z_6 = UnitZ(Factor=0.1)
tag_8 = TextTag3D(Location=prot, Text=panel_71, Size=12, Colour=text_2_3, Justification=7)
argb_4 = SplitARGB(Colour=road_2)  # -> Alpha, Red, Green, Blue
lng_6 = ListLength(List=mesh_8)
item_29 = ListItem(List=visualization_switch, Index=graft(dispatch_14.ListA), Wrap=False)
boundary = BoundarySurfaces(Edges=polygon.Polygon)
remap_13 = RemapNumbers(Value=graph_4, Source=Domain(0, 1), Target=dom_9)  # -> Mapped, Clipped
remap_14 = RemapNumbers(Value=graph_3, Source=Domain(0, 1), Target=dom_10)  # -> Mapped, Clipped
remap_15 = RemapNumbers(Value=graph_2, Source=Domain(0, 1), Target=dom_11)  # -> Mapped, Clipped

# ---- group: mesh on lego (dynamic only)
mesh_9 = Mesh(move_33.Geometry)

# ----
mcol_2 = MeshColours(Mesh=move_30.Geometry, Colours=ColourSwatch(SwatchColor=RGB(86, 120, 32)))
move_34 = Move(Geometry=mcol_2, Motion=Z_5)  # -> Geometry, Transform
mcol_3 = MeshColours(Mesh=move_32.Geometry, Colours=ColourSwatch(SwatchColor=RGB(196, 167, 86)))
move_35 = Move(Geometry=mcol_3, Motion=Z_6)  # -> Geometry, Transform
vec_5 = VectorXYZ(XComponent=argb_4.Red, YComponent=argb_4.Green, ZComponent=argb_4.Blue)  # -> Vector, Length
subtraction_4 = Subtraction(A=lng_6, B=1)
gate = StreamGate(Stream=frgb_5, Gate=slider_1_visualization_switch_9)  # -> Target0, Target1, Target2, Target3, Target4, Target5, Target6, Target7
gate_2 = StreamGate(Stream=mesh_9, Gate=slider_1_visualization_switch_9)  # -> Target0, Target1, Target2, Target3, Target4, Target5, Target6, Target7
pshift_28 = ShiftPaths(Data=item_29, Offset=-1)
rec_15 = DataRecorder(python_14.Centerpoints_Out, DataLimit=-10, RecordData=True)
rec_16 = DataRecorder(python_14.Intersections_Out, DataLimit=-10, RecordData=True)
rec_17 = DataRecorder(python_14.Roads_Out, DataLimit=-10, RecordData=True)
rec_18 = DataRecorder(python_14.Centerlines_Out, DataLimit=-10, RecordData=True)
pt_20 = Point(python_14.Intersections_In)
pt_21 = PointCylindrical(
    BasePlane=graft(building_population_calc.S_base_planes),
    Angle=building_population_calc.S_angles,
    Radius=remap_13.Mapped,
    Elevation=0)
origin_mesh = Mesh(boundary)
pt_22 = PointCylindrical(
    BasePlane=graft(building_population_calc.L_base_planes),
    Angle=building_population_calc.L_angles,
    Radius=remap_14.Mapped,
    Elevation=0)
pt_23 = PointCylindrical(
    BasePlane=graft(building_population_calc.M_base_planes),
    Angle=building_population_calc.M_angles,
    Radius=remap_15.Mapped,
    Elevation=0)
multiplication_20 = Multiplication(A=vec_5.Vector, B=subtraction_3)
lng_7 = ListLength(List=pt_19)
dom_12 = ConstructDomain(DomainStart=0, DomainEnd=subtraction_4)
diversity_heatmap_color = Colour([RGBA(255, 130, 0, 171), RGBA(255, 130, 0, 171), RGBA(255, 130, 0, 171), RGBA(255, 130, 0, 171), RGBA(255, 130, 0, 171), RGBA(255, 116, 0, 171)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])
office_heatmap_color = Colour([RGBA(135, 195, 0, 171), RGBA(255, 2, 0, 171), RGBA(255, 2, 0, 171), RGBA(255, 0, 0, 171), RGBA(255, 0, 0, 171), RGBA(255, 8, 0, 171)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])
home_heatmap_color = Colour([RGBA(135, 195, 0, 171), RGBA(255, 160, 0, 171), RGBA(255, 151, 0, 171), RGBA(255, 161, 0, 171), RGBA(255, 242, 0, 171), RGBA(255, 112, 0, 171)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])
park_heatmap_color = Colour([RGBA(135, 195, 0, 171), RGBA(255, 123, 0, 171), RGBA(255, 215, 0, 171), RGBA(255, 237, 0, 171), RGBA(255, 237, 0, 171), RGBA(255, 211, 0, 171)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])
office_heatmap_mesh = Mesh([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])
home_heatmap_mesh = Mesh([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])
park_heatmap_mesh = Mesh([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])
diversity_heatmap_mesh = Mesh([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])
rotate_2 = Rotate(Geometry=pshift_28, Angle=degrees(180), Plane=PlaneXY(0, 0, 0))  # -> Geometry, Transform
null_2 = NullItem(Item=rec_18)  # -> NullFlags, InvalidFlags, Description
null_3 = NullItem(Item=rec_15)  # -> NullFlags, InvalidFlags, Description
null_4 = NullItem(Item=rec_16)  # -> NullFlags, InvalidFlags, Description
random_2 = Random(Range=dom_12, Number=lng_7, Seed=Slider(26, range=0..100))
dispatch_15 = Dispatch(List=visualization_switch_2, DispatchPattern=python_13.equals_module)  # -> ListA, ListB
null_5 = NullItem(Item=rec_17)  # -> NullFlags, InvalidFlags, Description
move_36 = Move(Geometry=origin_mesh, Motion=pt_22)  # -> Geometry, Transform
move_37 = Move(Geometry=origin_mesh, Motion=pt_23)  # -> Geometry, Transform
move_38 = Move(Geometry=origin_mesh, Motion=pt_21)  # -> Geometry, Transform
dispatch_16 = Dispatch(List=rec_18, DispatchPattern=null_2.NullFlags)  # -> ListA, ListB
dispatch_17 = Dispatch(List=rec_16, DispatchPattern=null_4.NullFlags)  # -> ListA, ListB
dispatch_18 = Dispatch(List=rec_15, DispatchPattern=null_3.NullFlags)  # -> ListA, ListB
item_30 = ListItem(List=mesh_8, Index=random_2, Wrap=False)
dispatch_19 = Dispatch(List=rec_17, DispatchPattern=null_5.NullFlags)  # -> ListA, ListB
black = ColourSwatch(SwatchColor=RGB(0, 0, 0))
vec2pt_8 = Vector2Pt(PointA=Point(0, 0, 0), PointB=pt_19, Unitize=False)  # -> Vector, Length
filter_44 = StreamFilter(
    Gate=slider_1_visualization_switch_9,
    Stream2=office_heatmap_color,
    Stream3=home_heatmap_color,
    Stream4=park_heatmap_color,
    Stream7=diversity_heatmap_color)
filter_45 = StreamFilter(
    Gate=slider_1_visualization_switch_9,
    Stream2=office_heatmap_mesh,
    Stream3=home_heatmap_mesh,
    Stream4=park_heatmap_mesh,
    Stream7=diversity_heatmap_mesh)
exc_elderly = ColourSwatch(SwatchColor=RGB(255, 0, 0))
mjoin = MeshJoin(Meshes=move_36.Geometry)
mjoin_2 = MeshJoin(Meshes=move_37.Geometry)
mjoin_3 = MeshJoin(Meshes=move_38.Geometry)
mid_mid_career = ColourSwatch(SwatchColor=RGB(255, 208, 0))
vec2pt_9 = Vector2Pt(PointA=Point(0, 0, 0), PointB=dispatch_15.ListA, Unitize=False)  # -> Vector, Length
mln_young = ColourSwatch(SwatchColor=RGB(0, 166, 255))
move_39 = Move(Geometry=item_30, Motion=vec2pt_8.Vector)  # -> Geometry, Transform

# ---- group: random profile colors
col_5 = Colour(black)

# ----
move_40 = Move(Geometry=rotate_2.Geometry, Motion=vec2pt_9.Vector)  # -> Geometry, Transform
mcol_4 = MeshColours(Mesh=mjoin_3, Colours=mln_young)
mcol_5 = MeshColours(Mesh=mjoin_2, Colours=mid_mid_career)
mcol_6 = MeshColours(Mesh=mjoin, Colours=exc_elderly)
preview_13 = CustomPreview(Geometry=filter_45, Shader=filter_44)
centerpoints = Point([python_14.Centerpoints_In, python_14.Centerpoints_Buffer, dispatch_18.ListB])
centerpoints_2 = Point(centerpoints)
intersections = Point([pt_20, dispatch_17.ListB])

# ---- group: intersections
crossings = Point(intersections)

# ----
filter_46 = StreamFilter(Gate=slider_1_visualization_switch_9, Stream8=crossings, Stream9=crossings)
cp_3 = ClosestPoint(Point=centerpoints_2, Cloud=filter_46)  # -> ClosestPoint, CPIndex, Distance

# ---- group: min dis to intersections
num_3 = Number(cp_3.Distance)

# ----
bnd_9 = Bounds(Numbers=num_3)
remap_16 = RemapNumbers(Value=num_3, Source=Domain(0, 300), Target=Domain(0, 1))  # -> Mapped, Clipped
subtraction_5 = Subtraction(A=1, B=remap_16.Mapped)
graph_5 = GraphMapper(
    subtraction_5,
    x0=0,
    x1=1,
    y0=0,
    y1=0.5,
    container_name="Bezier",
    cpx=[0, 0.1613658518, 0.7159118652, 1],
    cpy=[0, 0.3613502979, 0.9704423547, 1])
multiplication_21 = Multiplication(A=graph_5, B=remap_9.Mapped)
addition_10 = Addition(A=remap_10.Mapped, B=multiplication_21)
addition_11 = Addition(A=addition_10, B=multiplication_17)
gradient_3 = Gradient(LowerLimit=0, UpperLimit=1, Parameter=addition_11, stops=[0: RGB(0, 128, 0), 0.524: RGB(255, 255, 0), 1: RGB(255, 0, 0)])
argb_5 = SplitARGB(Colour=gradient_3)  # -> Alpha, Red, Green, Blue
vec_6 = VectorXYZ(XComponent=argb_5.Red, YComponent=argb_5.Green, ZComponent=argb_5.Blue)  # -> Vector, Length
multiplication_22 = Multiplication(A=vec_6.Vector, B=number_slider_11)
addition_12 = Addition(A=multiplication_22, B=multiplication_20)
pdecon_5 = Deconstruct(Point=addition_12)  # -> XComponent, YComponent, ZComponent
frgb_6 = ColourRGBF(Alpha=1, Red=pdecon_5.XComponent, Green=pdecon_5.YComponent, Blue=pdecon_5.ZComponent)

# ---- group: heatmap
preview_14 = CustomPreview(Geometry=mesh_9, Shader=frgb_5)

# ----
roads = Mesh([python_14.Roads_Buffer, dispatch_19.ListB])
centerline = Mesh([python_14.Centerlines_In, python_14.Centerlines_Buffer, dispatch_16.ListB])
full_site_centerline = Mesh(centerline)
filter_47 = StreamFilter(Gate=slider_1_visualization_switch_9, Stream8=full_site_centerline, Stream9=full_site_centerline)
mspray = MeshSpray(Mesh=graft(filter_47), Points=graft(centerpoints_2), Colours=graft(frgb_6), SprayMode=0)
equals_19 = Equality(FirstNumber=slider_1_visualization_switch_8, SecondNumber=1)  # -> Equality, Inequality
mcol_7 = MeshColours(Mesh=graft(move_39.Geometry), Colours=graft(col_5))
mjoin_4 = MeshJoin(Meshes=flatten(mspray))
equals_20 = Equality(FirstNumber=slider_1_visualization_switch_7, SecondNumber=0)  # -> Equality, Inequality
filter_48 = StreamFilter(Gate=equals_20.Inequality, Stream1=roads)
mjoin_5 = MeshJoin(Meshes=flatten([mcol_6, mcol_5, mcol_4]))
layers_5 = CreateModifyLayers(LayerName="human dots - outer site", Visibility=equals_19.Equality, DeleteLayer=False, enableFullPath=False)  # -> LayerNames, LayerFullPath
pshift_29 = ShiftPaths(Data=mcol_7, Offset=-1)
full_site_building_mesh = Mesh(move_40.Geometry)
slider_1_visualization_switch_10 = Integer(slider_1_visualization_switch_2)

# ---- group: 3rd Places Meshes
mesh_10 = Mesh(pshift_29)

# ----
mjoin_6 = MeshJoin(Meshes=full_site_building_mesh)
slider_1_visualization_switch_11 = Integer(slider_1_visualization_switch_2)
visualization_switch_3 = StreamFilter(Gate=slider_1_visualization_switch_10, Stream6=mesh_10)
# RADAR CHART
category_text_size = Slider(14, range=0..21)
category_text_size_2 = Slider(25, range=0..50)
hide = Boolean(False)
show = Boolean(True)
radar_chart_size = Slider(450, range=0..500)
tick_resolution = Slider(22, range=0..22)
normalized_proposed_scores = Number(simplify(proposed_remapped))
normalized_existing_scores = Number(simplify(existing_remapped))
normalized_barcelona_scores = Number(simplify(barcelona_remapped))
building_mesh = Mesh(move_31.Geometry)
blank_mesh = Mesh(move_34.Geometry)
plaza_mesh = Mesh(move_35.Geometry)

# ---- group: 3rd Places Meshes
mesh_11 = Mesh(visualization_switch_3)

# ----
# building mesh - outer site
panel_72 = Panel("building mesh - projected")
group_titles = Text(simplify(graft(chart_group_titles)))
site_change_fill = ColourSwatch(SwatchColor=RGBA(93, 157, 207, 69))
proposed_site = ColourSwatch(SwatchColor=RGBA(140, 191, 230, 159))
radar_chart_center = Point(<point referenced from the Rhino model>)
existing_site = ColourSwatch(SwatchColor=RGBA(93, 127, 153, 175))
barcelona_6 = ColourSwatch(SwatchColor=RGBA(58, 255, 91, 136))
visualization_switch_4 = StreamFilter(
    Gate=slider_1_visualization_switch_11,
    Stream0=hide,
    Stream1=show,
    Stream2=show,
    Stream3=show,
    Stream4=show,
    Stream5=hide,
    Stream6=hide,
    Stream7=show,
    Stream8=hide,
    Stream9=hide)
categories = Text(simplify(all_radar_chart_titles))
direct_indirect = Boolean(Tree({0}: [True, True, False, False, False, True, False], {1}: [False, False, False, False], {2}: [True, False, False, False, False, False, False], {3}: [True, True, True, False, False, False]))
full_site_building_mesh_to_bake = Mesh(mjoin_6)
roads_interactive_part = Mesh(python_14.Roads_In)
roads_outer_site = Mesh(filter_48)
layers_6 = CreateModifyLayers(LayerName=panel_72, Visibility=visualization_switch_4, DeleteLayer=False, enableFullPath=False)  # -> LayerNames, LayerFullPath
df = ParamViewer(group_titles)
# SLIDER DISPLAY
of_visualization_categories = Slider(9, range=0..10)
division_10 = Division(A=radar_chart_size, B=tick_resolution)
# 3.3 DOCK / SLIDER DISPLAY
_2_1_excel_parsing_4 = Panel("Meshes")
# DOCK ID DISPLAY
module_type_reference_mesh_origin_0_to_5_5 = Mesh(module_type_reference_mesh_origin_0_to_5)
cull_i_3 = CullIndex(List=df, Indices=Slider(1, range=0..3), Wrap=True)
default_value = Slider(0, range=0..9)
swatch = ColourSwatch(SwatchColor=RGB(46, 46, 46))
# DOCK BLD HEIGHT DISPLAY
number_slider_12 = Slider(4, range=4..10)
text_size_2 = Slider(12, range=0..100)
series_12 = Series(Start=division_10, Step=division_10, Count=tick_resolution)
slider_1_visualization_switch_12 = Number(slider_1_visualization_switch_2)
panel_73 = Panel("""Site Image
Bldg Types
Work Prox.
Home Prox.
Park Prox.
Agents
Amenities
Coll. Potential
Car Traffic
PEV Traffic""")
dock_display_reference_pt = Point(<point referenced from the Rhino model>)
slider_display_start_pt = Point(<point referenced from the Rhino model>)
slider_display_end_pt = Point(<point referenced from the Rhino model>)
repeat_10 = RepeatData(Data=swatch, Length=expr("x-1", tick_resolution))  # -> flatten(Data)
circle = CircleCNR(Center=radar_chart_center, Normal=Vector(0, 0, 1), Radius=series_12)  # -> reverse(Circle)
rock_rotation = Integer(Slider(180, range=0..1000))
dock_id_5 = Integer(dock_id)
branch = TreeBranch(Tree=normalized_existing_scores, Path=cull_i_3, MaintainPaths=False)
branch_2 = TreeBranch(Tree=normalized_proposed_scores, Path=cull_i_3, MaintainPaths=False)
branch_3 = TreeBranch(Tree=group_titles, Path=cull_i_3, MaintainPaths=False)
branch_4 = TreeBranch(Tree=categories, Path=cull_i_3, MaintainPaths=False)
branch_5 = TreeBranch(Tree=direct_indirect, Path=cull_i_3, MaintainPaths=False)
dock_id_6 = Integer(dock_id)
dock_id_7 = Integer(dock_id)
branch_6 = TreeBranch(Tree=normalized_barcelona_scores, Path=cull_i_3, MaintainPaths=False)
rotate_3 = Rotate(Geometry=circle, Angle=-1.570796327, Plane=radar_chart_center)  # -> Geometry, Transform
lng_8 = ListLength(List=branch_4)  # -> flatten(Length)
start_i = ListItem(List=branch_4, Index=0, Wrap=True)
end_i = ListItem(List=branch_4, Index=-1, Wrap=True)
entwine_7 = Entwine(Branch00=branch, Branch01=branch_2, Branch02=branch_6, FlattenInputs=True)
equals_21 = Equality(FirstNumber=dock_id_5, SecondNumber=-1)  # -> Equality, Inequality
ln_5 = Line(StartPoint=slider_display_start_pt, EndPoint=slider_display_end_pt)
null_6 = NullItem(Item=slider_1_visualization_switch_12)  # -> NullFlags, InvalidFlags, Description
item_31 = ListItem(List=module_type_reference_mesh_origin_0_to_5_5, Index=dock_id_6, Wrap=False)

# ---- group: ref mask srf - R
srf = Surface(<surface referenced from the Rhino model>)  # disabled

# ---- group: ref mask srf - RM
srf_2 = Surface(<surface referenced from the Rhino model>)  # disabled

# ---- group: ref mask srf - bar live
srf_3 = Surface(<surface referenced from the Rhino model>)  # disabled

# ---- group: ref mask srf - RS
srf_4 = Surface(<surface referenced from the Rhino model>)  # disabled

# ---- group: ref mask srf - RL
srf_5 = Surface(<surface referenced from the Rhino model>)  # disabled

# ----
dock_bldg_display = PythonScript(
    dockID=dock_id_7,
    curr_dock_display=building_height_calculations.curr_dock_display,
    box_height=number_slider_12,
    box_width=Slider(25, range=5..50),
    axo_size=Slider(9, range=2..15))  # -> out, simplify(output); inputs dockID: Int32, curr_dock_display: list of Int32
# ---------- dock_bldg_display: Python ----------
import rhinoscriptsyntax as rs
import clr
clr.AddReference("Grasshopper")
import rhinoscriptsyntax as rs
def list_to_tree(input, none_and_holes=True, source=[0]):
    """Transforms nestings of lists or tuples to a Grasshopper DataTree"""
    from Grasshopper import DataTree as Tree
    from Grasshopper.Kernel.Data import GH_Path as Path
    from System import Array
    def proc(input,tree,track):
        path = Path(Array[int](track))
        if len(input) == 0 and none_and_holes: tree.EnsurePath(path); return
        for i,item in enumerate(input):
            if hasattr(item, '__iter__'): #if list or tuple
                track.append(i); proc(item,tree,track); track.pop()
            else:
                if none_and_holes: tree.Insert(item,path,i)
                elif item is not None: tree.Add(item,path)
    if input is not None: t=Tree[object]();proc(input,t,source[:]);return t



plane = rs.WorldXYPlane()

box_c = rs.AddPlaneSurface(plane, box_width, box_height)
box_b = rs.ScaleObject(box_c, (0,0,0), (1.2,1,1), True)
box_a = rs.ScaleObject(box_c, (0,0,0), (1.4,1,1), True)
boxes = [box_a, box_b, box_c]
txt = ["RL", "RM", "RS", "OL", "OM", "OS", "retail"]
output = []
y = 0

if curr_dock_display[-1] == 0:
    curr_dock_display.pop()


for i in range(0, len(curr_dock_display)):
    box_out = []
    axo_out = []
    text_out = []
    pt_out = []
    y_start = y
    for j in range(0,curr_dock_display[i]):
        box_out.append(rs.CopyObject(boxes[i], (0,y,0)))
        y += box_height
    pts = [(0,y_start,0),(0,y,0),(-axo_size,y+axo_size,0),(-axo_size,y_start+axo_size,0), (0,y_start,0)]
    axo_out.append(rs.AddPolyline(pts))
    if i == 0:
        text_out.append(txt[6])
    if i == 1:
        if len(curr_dock_display) == 3 and dockID < 3:
            text_out.append(txt[dockID + 3])
        else:
            text_out.append(txt[dockID])
    if i == 2:
        text_out.append(txt[dockID])
    center_x = rs.SurfaceAreaCentroid(boxes[i])[0][0]
    center_y = (y - y_start) / 2 + y_start
    pt_out.append(rs.AddPoint(((center_x*2 + 10),center_y, 0)))
    if i == len(curr_dock_display)-1 :
        pts = [(-axo_size,y+axo_size,0),(center_x*2 - axo_size, y+axo_size,0),(center_x*2, y,0)]
        axo_out.append(rs.AddPolyline(pts))
    output.append([box_out,axo_out,text_out,pt_out])


output = list_to_tree(output)
# ---------- end dock_bldg_display ----------
divide_2 = DivideCurve(Curve=ln_5, Count=of_visualization_categories, Kinks=False)  # -> Points, Tangents, Parameters
filter_49 = StreamFilter(Gate=null_6.NullFlags, Stream0=slider_1_visualization_switch_12, Stream1=default_value)
ma_13 = MassAddition(Input=lng_8)  # -> Result, PartialResults
index_3 = ItemIndex(List=flatten(branch_4), Item=start_i)
index_4 = ItemIndex(List=flatten(branch_4), Item=end_i)
rotate_4 = Rotate(Geometry=item_31, Angle=degrees(rock_rotation), Plane=PlaneXY(0, 0, 0))  # -> Geometry, Transform
split_8 = SplitList(List=rotate_3.Geometry, Index=2)  # -> ListA, ListB
vec2pt_10 = Vector2Pt(PointA=Point(0, 0, 0), PointB=dock_display_reference_pt, Unitize=False)  # -> Vector, Length
slider_1_value = Integer(filter_49)
item_32 = ListItem(List=split_8.ListB, Index=0, Wrap=True)
divide_3 = DivideCurve(Curve=reparameterize(item_32), Count=ma_13.Result, Kinks=False)  # -> Points, Tangents, flatten(Parameters)
Z_7 = UnitZ(Factor=Slider(10, range=0..20))
move_41 = Move(Geometry=rotate_4.Geometry, Motion=vec2pt_10.Vector)  # -> Geometry, Transform
item_33 = ListItem(List=divide_3.Parameters, Index=index_3, Wrap=True)
panel_74 = Panel(slider_1_value)
item_34 = ListItem(List=divide_3.Parameters, Index=index_4, Wrap=True)
move_42 = Move(Geometry=move_41.Geometry, Motion=Z_7)  # -> Geometry, Transform
split_9 = SplitTree(Data=dock_bldg_display.output, Masks=flatten("{?;(0,1)}"))  # -> Positive, Negative
split_10 = SplitTree(Data=dock_bldg_display.output, Masks=flatten("{?;2}"))  # -> Positive, Negative
split_11 = SplitTree(Data=dock_bldg_display.output, Masks=flatten("{?;3}"))  # -> Positive, Negative
xy_5 = XYPlane(Origin=Point(0, 0, 0))
xy_6 = XYPlane(Origin=Point(0, 0, 0))
dom_13 = ConstructDomain(DomainStart=item_33, DomainEnd=item_34)
dom_14 = ConstructDomain(DomainStart=index_3, DomainEnd=index_4)
bldg_height_displa_ref_point = Point(<point referenced from the Rhino model>)
ln_6 = Line(StartPoint=radar_chart_center, EndPoint=divide_3.Points)
rotate_5 = Rotate(Geometry=xy_5, Angle=degrees(180), Plane=PlaneXY(0, 0, 0))  # -> Geometry, Transform
rotate_6 = Rotate(Geometry=xy_6, Angle=degrees(180), Plane=PlaneXY(0, 0, 0))  # -> Geometry, Transform
item_35 = ListItem(List=divide_2.Points, Index=slider_1_value, Wrap=True)
item_36 = ListItem(List=panel_73, Index=slider_1_value, Wrap=True)
cull_i_4 = CullIndex(List=divide_2.Points, Indices=slider_1_value, Wrap=True)
cull_i_5 = CullIndex(List=panel_73, Indices=slider_1_value, Wrap=True)
item_37 = ListItem(List=split_8.ListA, Index=0, Wrap=True)  # -> Item, Item1
subcrv_2 = SubCurve(BaseCurve=reparameterize(item_37.Item1), Domain=dom_13)
pshift_30 = ShiftPaths(Data=split_9.Positive, Offset=-1)
pshift_31 = ShiftPaths(Data=split_10.Positive, Offset=-1)
pshift_32 = ShiftPaths(Data=split_11.Positive, Offset=-1)
subset = SubList(List=divide_3.Parameters, Domain=dom_14, Wrap=True)  # -> List, Index
vec2pt_11 = Vector2Pt(PointA=Point(0, 0, 0), PointB=item_35, Unitize=False)  # -> Vector, Length
filter_50 = StreamFilter(Gate=equals_21.Inequality, Stream0=cull_i_5)
vec2pt_12 = Vector2Pt(PointA=Point(0, 0, 0), PointB=cull_i_4, Unitize=False)  # -> Vector, Length
filter_51 = StreamFilter(Gate=equals_21.Inequality, Stream0=item_36)
active_color = ColourSwatch(SwatchColor=RGB(255, 255, 255))
inactive_color = ColourSwatch(SwatchColor=RGB(138, 138, 138))
vec2pt_13 = Vector2Pt(PointA=Point(0, 0, 0), PointB=bldg_height_displa_ref_point, Unitize=False)  # -> Vector, Length
xy_7 = XYPlane(Origin=pshift_32)
vec2pt_14 = Vector2Pt(PointA=Point(0, 0, 0), PointB=bldg_height_displa_ref_point, Unitize=False)  # -> Vector, Length

# ---- group: ref mask srf - O
srf_6 = Surface(<surface referenced from the Rhino model>)  # disabled

# ---- group: ref mask srf - OM
srf_7 = Surface(<surface referenced from the Rhino model>)  # disabled

# ---- group: ref mask srf - bar work
srf_8 = Surface(<surface referenced from the Rhino model>)  # disabled

# ---- group: ref mask srf - OS
srf_9 = Surface(<surface referenced from the Rhino model>)  # disabled

# ---- group: ref mask srf - OL
srf_10 = Surface(<surface referenced from the Rhino model>)  # disabled

# ----
move_43 = Move(Geometry=rotate_5.Geometry, Motion=vec2pt_11.Vector)  # -> Geometry, Transform
move_44 = Move(Geometry=rotate_6.Geometry, Motion=vec2pt_12.Vector)  # -> Geometry, Transform
move_45 = Move(Geometry=pshift_30, Motion=vec2pt_13.Vector)  # -> Geometry, Transform
move_46 = Move(Geometry=xy_7, Motion=vec2pt_14.Vector)  # -> Geometry, Transform

# ---- group: mask settings
swatch_2 = ColourSwatch(SwatchColor=RGBA(0, 0, 0, 223))  # disabled
panel_75 = Panel(".1")  # disabled
path = FilePath("C:\Users\CPG_Andorra\Dropbox (Changing Places)\CPG_PROJECTS\CPG_CITYSCOPE\CityMatrix_Andorra\Development\Data\MAP_BLACK.png")

# ----
# 3.1 Activation mask: Activation mask for hiding or graying out all other modules when one brick is selected by the dock.
# Activation Mask
cell_size_shrink_factor_5 = Number(cell_size_shrink_factor)  # disabled
masked_module_id_5 = Integer(masked_module_id)  # disabled
mask_setting = ColourSwatch(SwatchColor=RGBA(0, 0, 0, 185))  # disabled
module_center_3 = Point(module_center_2)  # disabled
dock_id_8 = Integer(pshift_10)  # disabled
addition_13 = Addition(A=cell_size_shrink_factor_5, B=0.05)  # disabled
panel_76 = Panel("-2")  # disabled
number_slider_13 = Slider(10.8, range=0..110)  # disabled
mesh_12 = Mesh(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)  # disabled
num_4 = Number(addition_13)  # disabled
panel_77 = Panel("-1")  # disabled
equals_22 = Equality(FirstNumber=masked_module_id_5, SecondNumber=panel_76)  # -> Equality, Inequality; disabled
equals_23 = Equality(FirstNumber=masked_module_id_5, SecondNumber=dock_id_8)  # -> Equality, Inequality; disabled
scale_nu_3 = ScaleNU(Geometry=mesh_12, Plane=PlaneXY(0, 0, 0), ScaleX=num_4, ScaleY=num_4, ScaleZ=1)  # -> Geometry, Transform; disabled
equals_24 = Equality(FirstNumber=dock_id_8, SecondNumber=panel_77)  # -> Equality, Inequality; disabled
panel_78 = Panel("2")  # disabled
panel_79 = Panel("1")  # disabled
panel_80 = Panel("0")  # disabled
panel_81 = Panel("-1")  # disabled
Z_8 = UnitZ(Factor=number_slider_13)  # disabled
and_3 = GateAnd(A=equals_23.Inequality, B=equals_22.Inequality)  # disabled
equals_25 = Equality(FirstNumber=dock_id_8, SecondNumber=panel_78)  # -> Equality, Inequality; disabled
equals_26 = Equality(FirstNumber=dock_id_8, SecondNumber=panel_79)  # -> Equality, Inequality; disabled
and_4 = GateAnd(A=equals_25.Inequality, B=equals_26.Inequality)  # disabled
equals_27 = Equality(FirstNumber=dock_id_8, SecondNumber=panel_80)  # -> Equality, Inequality; disabled
and_5 = GateAnd(A=and_4, B=equals_27.Inequality)  # disabled
equals_28 = Equality(FirstNumber=dock_id_8, SecondNumber=panel_81)  # -> Equality, Inequality; disabled
dispatch_20 = Dispatch(List=module_center_3, DispatchPattern=and_3)  # -> ListA, ListB; disabled
move_47 = Move(Geometry=scale_nu_3.Geometry, Motion=Z_8)  # -> Geometry, Transform; disabled
and_6 = GateAnd(A=and_5, B=equals_28.Inequality)  # disabled
and_7 = GateAnd(A=equals_25.Inequality, B=equals_28.Inequality)  # disabled
and_8 = GateAnd(A=equals_26.Inequality, B=equals_28.Inequality)  # disabled
and_9 = GateAnd(A=equals_27.Inequality, B=equals_28.Inequality)  # disabled
vec2pt_15 = Vector2Pt(PointA=Point(0, 0, 0), PointB=dispatch_20.ListA, Unitize=False)  # -> Vector, Length; disabled
filter_52 = StreamFilter(Gate=and_8, Stream1=srf_2)  # disabled
filter_53 = StreamFilter(Gate=and_6, Stream1=srf_3)  # disabled
filter_54 = StreamFilter(Gate=and_7, Stream1=srf_4)  # disabled
filter_55 = StreamFilter(Gate=and_9, Stream1=srf_5)  # disabled
filter_56 = StreamFilter(Gate=and_6, Stream1=srf)  # disabled
move_48 = Move(Geometry=move_47.Geometry, Motion=vec2pt_15.Vector)  # -> Geometry, Transform; disabled
preview_15 = CustomPreview(Geometry=filter_56, Shader=mask_setting)  # disabled
preview_16 = CustomPreview(Geometry=filter_54, Shader=mask_setting)  # disabled
preview_17 = CustomPreview(Geometry=filter_52, Shader=mask_setting)  # disabled
preview_18 = CustomPreview(Geometry=filter_55, Shader=mask_setting)  # disabled
preview_19 = CustomPreview(Geometry=filter_53, Shader=mask_setting)  # disabled
mjoin_7 = MeshJoin(Meshes=move_48.Geometry)  # disabled
filter_57 = StreamFilter(Gate=equals_24.Equality, Stream0=mjoin_7)  # disabled
panel_82 = Panel("5")  # disabled
panel_83 = Panel("4")  # disabled
panel_84 = Panel("3")  # disabled
equals_29 = Equality(FirstNumber=dock_id_8, SecondNumber=panel_82)  # -> Equality, Inequality; disabled
equals_30 = Equality(FirstNumber=dock_id_8, SecondNumber=panel_83)  # -> Equality, Inequality; disabled
and_10 = GateAnd(A=equals_29.Inequality, B=equals_30.Inequality)  # disabled
equals_31 = Equality(FirstNumber=dock_id_8, SecondNumber=panel_84)  # -> Equality, Inequality; disabled
and_11 = GateAnd(A=and_10, B=equals_31.Inequality)  # disabled
and_12 = GateAnd(A=and_11, B=equals_28.Inequality)  # disabled
and_13 = GateAnd(A=equals_29.Inequality, B=equals_28.Inequality)  # disabled
and_14 = GateAnd(A=equals_30.Inequality, B=equals_28.Inequality)  # disabled
and_15 = GateAnd(A=equals_31.Inequality, B=equals_28.Inequality)  # disabled
custom_preview_materials = CustomPreviewMaterials(Geometry=filter_57, DiffuseColor=swatch_2, Transparency=panel_75, DiffuseBitmap=path)  # disabled
filter_58 = StreamFilter(Gate=and_14, Stream1=srf_7)  # disabled
filter_59 = StreamFilter(Gate=and_12, Stream1=srf_8)  # disabled
filter_60 = StreamFilter(Gate=and_13, Stream1=srf_9)  # disabled
filter_61 = StreamFilter(Gate=and_15, Stream1=srf_10)  # disabled
filter_62 = StreamFilter(Gate=and_12, Stream1=srf_6)  # disabled
preview_20 = CustomPreview(Geometry=filter_57, Shader=swatch_2)  # disabled
preview_21 = CustomPreview(Geometry=filter_62, Shader=mask_setting)  # disabled
preview_22 = CustomPreview(Geometry=filter_60, Shader=mask_setting)  # disabled
preview_23 = CustomPreview(Geometry=filter_58, Shader=mask_setting)  # disabled
preview_24 = CustomPreview(Geometry=filter_61, Shader=mask_setting)  # disabled
preview_25 = CustomPreview(Geometry=filter_59, Shader=mask_setting)  # disabled

rotate_7 = Rotate(Geometry=move_45.Geometry, Angle=degrees(Slider(180, range=0..1000)), Plane=bldg_height_displa_ref_point)  # -> Geometry, Transform
rotate_8 = Rotate(Geometry=move_46.Geometry, Angle=degrees(Slider(180, range=0..1000)), Plane=bldg_height_displa_ref_point)  # -> Geometry, Transform
office_2 = ColourSwatch(SwatchColor=RGBA(0, 117, 153, 55))
eval_7 = EvaluateCurve(Curve=reparameterize(ln_6), Parameter=entwine_7)  # -> Point, Tangent, Angle
retail = ColourSwatch(SwatchColor=RGBA(209, 0, 178, 55))
retail_2 = ColourSwatch(SwatchColor=RGBA(255, 255, 255, 72))
eval_8 = EvaluateCurve(Curve=reparameterize(subcrv_2), Parameter=0.5)  # -> Point, Tangent, Angle
eval_9 = EvaluateCurve(Curve=reparameterize(item_37.Item1), Parameter=subset.List)  # -> Point, Tangent, Angle
eval_10 = EvaluateCurve(Curve=reparameterize(item_37.Item), Parameter=subset.List)  # -> Point, Tangent, Angle
larger_3 = LargerThan(FirstNumber=subset.List, SecondNumber=0.5)  # -> LargerThan, OrEqualTo
pline_2 = PolyLine(Vertices=eval_7.Point, Closed=True)
vrot = Rotate(Vector=eval_8.Tangent, Axis=Vector(0, 0, 1), Angle=degrees(270))
slider_active = TextTag3D(Location=move_43.Geometry, Text=filter_51, Size=text_size_2, Colour=active_color, Justification=4)
slider_inactive = TextTag3D(Location=move_44.Geometry, Text=filter_50, Size=text_size_2, Colour=inactive_color, Justification=4)
dock_module = Mesh(move_42.Geometry)
preview_26 = CustomPreview(Geometry=rotate_7.Geometry, Shader=graft([retail, office_2, retail_2]))
justified_text = JustifiedText3d(
    Location=rotate_8.Geometry,
    Text=pshift_31,
    Size=6,
    Color=[retail, office_2, retail_2],
    HorizontalAlignment=1,
    VerticalAlginment=1,
    UseMeshes=False,
    Bake=False)
circle_2 = CircleCNR(Center=eval_9.Point, Normal=Vector(0, 0, 1), Radius=4)
dispatch_21 = Dispatch(List=eval_10.Tangent, DispatchPattern=larger_3.LargerThan)  # -> ListA, ListB
dispatch_22 = Dispatch(List=eval_10.Point, DispatchPattern=larger_3.LargerThan)  # -> ListA, ListB
dispatch_23 = Dispatch(List=subset.List, DispatchPattern=larger_3.LargerThan)  # -> ListA, ListB
dispatch_24 = Dispatch(List=branch_4, DispatchPattern=larger_3.LargerThan)  # -> ListA, ListB
dispatch_25 = Dispatch(List=branch_5, DispatchPattern=larger_3.LargerThan)  # -> ListA, ListB
item_38 = ListItem(List=flatten(pline_2), Index=0, Wrap=True)  # -> Item, Item1, Item2
amp = Amplitude(Vector=vrot, Amplitude=Slider(280, range=0..500))
vrot_2 = Rotate(Vector=dispatch_21.ListA, Axis=Vector(0, 0, 1), Angle=degrees(90))
vrot_3 = Rotate(Vector=dispatch_21.ListB, Axis=Vector(0, 0, 1), Angle=degrees(270))
boundary_2 = BoundarySurfaces(Edges=circle_2)
text_2_4 = ColourSwatch(SwatchColor=RGB(102, 102, 102))
text_1_2 = ColourSwatch(SwatchColor=RGB(191, 191, 191))
item_39 = ListItem(List=reverse([text_1_2, text_2_4]), Index=dispatch_25.ListB, Wrap=True)
item_40 = ListItem(List=reverse([text_1_2, text_2_4]), Index=dispatch_25.ListA, Wrap=True)
item_41 = ListItem(List=reverse([text_1_2, text_2_4]), Index=branch_5, Wrap=True)
move_49 = Move(Geometry=eval_8.Point, Motion=amp)  # -> Geometry, Transform
boundary_3 = BoundarySurfaces(Edges=graft([item_38.Item, item_38.Item1]))
move_50 = Move(Geometry=boundary_2, Motion=Vector(0, 0, 1))  # -> Geometry, Transform
align = AlignPlane(Plane=dispatch_22.ListA, Direction=vrot_2)  # -> Plane, Angle
align_2 = AlignPlane(Plane=dispatch_22.ListB, Direction=vrot_3)  # -> Plane, Angle
col_6 = Colour(text_2_4)
col_7 = Colour(graft([existing_site, proposed_site, barcelona_6]))
radar_rings = CustomPreview(Geometry=split_8.ListB, Shader=repeat_10)
radar_rays = CustomPreview(Geometry=ln_6, Shader=swatch)
score_lines = CustomPreviewLineweights(Geometry=pline_2, Shader=col_7, Thickness=1, Absolute=False)
change_fill = CustomPreview(Geometry=boundary_3, Shader=site_change_fill)
titles = TextTag3D(Location=move_49.Geometry, Text=branch_3, Size=category_text_size_2, Colour=text_1_2, Justification=5)
category_left = TextTag3D(Location=align.Plane, Text=dispatch_24.ListA, Size=category_text_size, Colour=item_40, Justification=6)
category_right = TextTag3D(Location=align_2.Plane, Text=dispatch_24.ListB, Size=category_text_size, Colour=item_39, Justification=4)
group = CustomPreview(Geometry=subcrv_2, Shader=graft(col_6))
radar_dots = CustomPreview(Geometry=move_50.Geometry, Shader=item_41)

# ==== cluster Perspective
int = ClusterInput()
int_2 = ClusterInput()
pt = ClusterInput()

# ---- group: grid extent y
int_3 = Integer(int)

# ---- group: grid extent x
int_4 = Integer(int_2)

# ---- group: Pts Sample Grid Corner
pt_2 = Point(pt)

# ----
subtraction = Subtraction(A=int_4, B=1)
subtraction_2 = Subtraction(A=int_3, B=1)
item = ListItem(List=pt_2, Index=0, Wrap=False)
item_2 = ListItem(List=pt_2, Index=1, Wrap=False)
item_3 = ListItem(List=pt_2, Index=2, Wrap=False)
item_4 = ListItem(List=pt_2, Index=3, Wrap=False)
pt_3 = Point(item_4)
pt_4 = Point(item)
ln = Line(StartPoint=pt_3, EndPoint=pt_4)
pt_5 = Point(item_2)
ln_2 = Line(StartPoint=pt_4, EndPoint=pt_5)
pt_6 = Point(item_3)
ln_3 = Line(StartPoint=pt_6, EndPoint=pt_3)
ln_4 = Line(StartPoint=pt_5, EndPoint=pt_6)
llx = LineLine(Line1=ln, Line2=ln_4)  # -> ParamA, ParamB, PointA, PointB
pt_7 = Point(llx.PointA)
llx_2 = LineLine(Line1=ln_2, Line2=ln_3)  # -> ParamA, ParamB, PointA, PointB
pt_8 = Point(llx_2.PointA)
vec2pt = Vector2Pt(PointA=pt_8, PointB=pt_7, Unitize=False)  # -> Vector, Length
line = LineSDL(Start=pt_3, Direction=vec2pt.Vector, Length=1)
llx_3 = LineLine(Line1=ln_2, Line2=line)  # -> ParamA, ParamB, PointA, PointB
pt_9 = Point(llx_3.PointA)
ln_5 = Line(StartPoint=pt_3, EndPoint=pt_9)
divide = DivideCurve(Curve=ln_5, Count=subtraction_2, Kinks=False)  # -> Points, Tangents, Parameters
ln_6 = Line(StartPoint=pt_8, EndPoint=divide.Points)
llx_4 = LineLine(Line1=ln_4, Line2=line)  # -> ParamA, ParamB, PointA, PointB
pt_10 = Point(llx_4.PointA)
ln_7 = Line(StartPoint=pt_3, EndPoint=pt_10)
divide_2 = DivideCurve(Curve=ln_7, Count=subtraction, Kinks=False)  # -> Points, Tangents, Parameters
ln_8 = Line(StartPoint=pt_7, EndPoint=divide_2.Points)
ln_9 = Line(StartPoint=pt_8, EndPoint=pt_7)

# ---- group: x
line_2 = Line(ln_8)

# ---- group: y
line_3 = Line(ln_6)

# ----
graft = GraftTree(Tree=ln_6, IncludeEmptyLists=True, IncludeNullItems=True)
llx_5 = LineLine(Line1=line_2, Line2=graft)  # -> ParamA, ParamB, PointA, PointB

# ---- group: keystoned grid pts
pt_11 = Point(llx_5.PointA)

# ----
pt_12 = ClusterOutput(pt_11)

# ==== cluster SliderCalc
P = ClusterInput()
C = ClusterInput()
cp = ClosestPoint(Point=graft(P), Cloud=C)  # -> ClosestPoint, CPIndex, Distance
pshift = ShiftPaths(Data=cp.CPIndex, Offset=-1)

# ---- group: color IDs
int = Integer(pshift)

# ----
panel = Panel(int)
L = ClusterInput()
int_2 = ClusterOutput(int)
dispatch = Dispatch(List=L, DispatchPattern=int)  # -> ListA, ListB
pdecon = Deconstruct(Point=dispatch.ListB)  # -> XComponent, YComponent, ZComponent
lng = ListLength(List=dispatch.ListB)
ma = MassAddition(Input=pdecon.XComponent)  # -> Result, PartialResults
ma_2 = MassAddition(Input=pdecon.YComponent)  # -> Result, PartialResults
division = Division(A=ma.Result, B=lng)
division_2 = Division(A=ma_2.Result, B=lng)
pt = ConstructPoint(XCoordinate=division, YCoordinate=division_2, ZCoordinate=0)
panel_2 = Panel(pt)
C_2 = ClusterInput()

# ---- group: average slide block pt
pt_2 = Point(pt)

# ----
crv_cp = CurveClosestPoint(Point=pt_2, Curve=C_2)  # -> Point, Parameter, Distance
pshift_2 = ShiftPaths(Data=crv_cp.Parameter, Offset=-1)
D = ClusterOutput(pshift_2)

# ==== cluster Move
num = ClusterInput()
G = ClusterInput()
num_2 = Number(num)
geobottomcenter = GeoBottomCenter(geo=G)
vec2pt = Vector2Pt(PointA=geobottomcenter, PointB=Point(0, 0, 0), Unitize=False)  # -> Vector, Length
move = Move(Geometry=G, Motion=vec2pt.Vector)  # -> Geometry, Transform
scale_nu = ScaleNU(Geometry=move.Geometry, Plane=PlaneXY(0, 0, 0), ScaleX=num_2, ScaleY=num_2, ScaleZ=1)  # -> ModuleMovedToOrigin, Transform
module_moved_to_origin = ClusterOutput(scale_nu.ModuleMovedToOrigin)

# ==== cluster ASCII
T = ClusterInput()
split = TextSplit(Text=T, Separators=" ")
item = ListItem(List=split, Index=1, Wrap=True)  # -> flatten(Item)
txt = Text(item)
trim = TextTrim(Text=txt, Start=True, End=True)
n_columns = Number(trim)
n_columns_2 = ClusterOutput(n_columns)

# ==== cluster ASCII_2
T = ClusterInput()
split = TextSplit(Text=T, Separators=" ")
item = ListItem(List=split, Index=1, Wrap=True)  # -> flatten(Item)
txt = Text(item)
trim = TextTrim(Text=txt, Start=True, End=True)
n_rows = Number(trim)
n_rows_2 = ClusterOutput(n_rows)

# ==== cluster MoveToOrgin
num = ClusterInput()
G = ClusterInput()
num_2 = Number(num)
geobottomcenter = GeoBottomCenter(geo=G)
vec2pt = Vector2Pt(PointA=geobottomcenter, PointB=Point(0, 0, 0), Unitize=False)  # -> Vector, Length
move = Move(Geometry=G, Motion=vec2pt.Vector)  # -> Geometry, Transform
scale_nu = ScaleNU(Geometry=move.Geometry, Plane=PlaneXY(0, 0, 0), ScaleX=num_2, ScaleY=num_2, ScaleZ=1)  # -> Geometry, Transform
G_2 = ClusterOutput(scale_nu.Geometry)

# ==== cluster Cluster
G = ClusterInput()
_1 = ClusterInput()
filter = StreamFilter(Gate=G, Stream1=_1)
s_0 = ClusterOutput(filter)

# ==== cluster Cluster_2
toggle = BooleanToggle(False)
road_reg_c = Mesh(graft([<mesh referenced from the Rhino model> x4]))
road_reg_o = Mesh(graft([<mesh referenced from the Rhino model> x4]))
sidewalk_reg_o = Mesh(graft([<mesh referenced from the Rhino model> x4]))
road_pev_c = Mesh(graft([<mesh referenced from the Rhino model> x4]))
sidewalk_pev_c = Mesh(graft([<mesh referenced from the Rhino model> x4]))
road_pev_o = Mesh(graft([<mesh referenced from the Rhino model> x4]))
sidewalk_pev_o = Mesh(graft([<mesh referenced from the Rhino model> x4]))
sidewalk_reg_c = Mesh(graft([<mesh referenced from the Rhino model> x4]))
number_slider = Slider(0.51, range=0..1)
scale_factor = ClusterInput()
is_pev = ClusterInput()
mjoin = MeshJoin(Meshes=[road_reg_c, sidewalk_reg_c])  # -> flatten(Mesh)
mjoin_2 = MeshJoin(Meshes=[sidewalk_reg_o, road_reg_o])  # -> flatten(Mesh)
mjoin_3 = MeshJoin(Meshes=[road_pev_c, sidewalk_pev_c])  # -> flatten(Mesh)
centerline_reg = Mesh([<mesh referenced from the Rhino model> x4])
point_reg = Point(<point referenced from the Rhino model>)
mjoin_4 = MeshJoin(Meshes=[road_pev_o, sidewalk_pev_o])  # -> flatten(Mesh)
center_reg_c = Point(<point referenced from the Rhino model>)
center_reg_o = Point(<point referenced from the Rhino model>)
center_pev_c = Point(<point referenced from the Rhino model>)
center_pev_o = Point(<point referenced from the Rhino model>)
point_pev = Point(<point referenced from the Rhino model>)
centerline_pev = Mesh([<mesh referenced from the Rhino model> x4])
scale_factor_2 = Number(scale_factor)
is_pev_2 = Boolean(is_pev)
scale_nu = ScaleNU(Geometry=mjoin, Plane=center_reg_c, ScaleX=scale_factor_2, ScaleY=scale_factor_2, ScaleZ=1)  # -> Geometry, Transform
scale_nu_2 = ScaleNU(Geometry=mjoin_2, Plane=center_reg_o, ScaleX=scale_factor_2, ScaleY=scale_factor_2, ScaleZ=1)  # -> Geometry, Transform
scale_nu_3 = ScaleNU(Geometry=centerline_reg, Plane=point_reg, ScaleX=scale_factor_2, ScaleY=scale_factor_2, ScaleZ=1)  # -> Geometry, Transform
scale_nu_4 = ScaleNU(Geometry=mjoin_3, Plane=center_pev_c, ScaleX=scale_factor_2, ScaleY=scale_factor_2, ScaleZ=1)  # -> Geometry, Transform
scale_nu_5 = ScaleNU(Geometry=mjoin_4, Plane=center_pev_o, ScaleX=scale_factor_2, ScaleY=scale_factor_2, ScaleZ=1)  # -> Geometry, Transform
scale_nu_6 = ScaleNU(Geometry=centerline_pev, Plane=point_pev, ScaleX=scale_factor_2, ScaleY=scale_factor_2, ScaleZ=1)  # -> Geometry, Transform
filter = StreamFilter(Gate=is_pev_2, Stream0=scale_nu.Geometry, Stream1=scale_nu_4.Geometry)
filter_2 = StreamFilter(Gate=is_pev_2, Stream0=scale_nu_2.Geometry, Stream1=scale_nu_5.Transform)
filter_3 = StreamFilter(Gate=is_pev_2, Stream0=scale_nu_3.Geometry, Stream1=scale_nu_6.Geometry)
filter_4 = StreamFilter(Gate=is_pev_2, Stream0=center_reg_c, Stream1=center_pev_c)
filter_5 = StreamFilter(Gate=is_pev_2, Stream0=center_reg_o, Stream1=center_pev_o)
filter_6 = StreamFilter(Gate=is_pev_2, Stream0=point_reg, Stream1=point_pev)
roads_c = Mesh(filter)
roads_o = Mesh(filter_2)
centerpoint_o = Point(filter_5)
centerline = Mesh(filter_3)
centerpoint_x = Point(filter_6)
centerpoint_c = Point(filter_4)
roads_c_2 = ClusterOutput(roads_c)
roads_o_2 = ClusterOutput(roads_o)
centerpoint_o_2 = ClusterOutput(centerpoint_o)
centerline_2 = ClusterOutput(centerline)
centerpoint_x_2 = ClusterOutput(centerpoint_x)
centerpoint_c_2 = ClusterOutput(centerpoint_c)

# ==== cluster GeoBottomCenter
geo = ClusterInput()
geo_2 = Geometry(geo)
bbox = BoundingBox(Content=geo_2, Plane=PlaneXY(0, 0, 0))  # -> Box, Box_2
box_corners = BoxCorners(Box=bbox.Box)  # -> CornerA, CornerB, CornerC, CornerD, CornerE, CornerF, CornerG, CornerH
pdecon = Deconstruct(Point=box_corners.CornerA)  # -> XComponent, YComponent, ZComponent
pdecon_2 = Deconstruct(Point=box_corners.CornerC)  # -> XComponent, YComponent, ZComponent
addition = Addition(A=pdecon.XComponent, B=pdecon_2.XComponent)
addition_2 = Addition(A=pdecon.YComponent, B=pdecon_2.YComponent)
division = Division(A=addition, B=2)
division_2 = Division(A=addition_2, B=2)
pt = ConstructPoint(XCoordinate=division, YCoordinate=division_2, ZCoordinate=pdecon.ZComponent)
pt_2 = Point(pt)
pt_3 = ClusterOutput(pt_2)
